# Grasshopper definition graph_in_rhino.gh (Grasshopper 1.0.8)

# ----
# GENERIC PANELS
# Create Reference
geometry = Geometry(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)
# GENERATE PANNUSTHEKA
geometry_2 = Geometry(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)
geometry_3 = Geometry(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)
geometry_4 = Geometry(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)
geometry_5 = Geometry([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])
geometry_6 = Geometry([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])
geometry_7 = Geometry([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])
geometry_8 = Geometry(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)
geometry_9 = Geometry(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)
geometry_10 = Geometry([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])
geometry_11 = Geometry(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)
geometry_12 = Geometry([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])
geometry_13 = Geometry([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])
geometry_14 = Geometry(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)
mesh_brep = MeshBrep(
    Brep=geometry_2,
    Settings={GridMaxCount=0, GridMinCount=16, JaggedSeams=False, MaxEdgeLength=0, MinEdgeLength=0.0001, MinTolerance=0, Refine=True, RefineAngle=0, RelativeTolerance=0.65, SimplePlanes=True, Tolerance=0})
mesh_brep_2 = MeshBrep(
    Brep=geometry,
    Settings={GridMaxCount=0, GridMinCount=16, JaggedSeams=False, MaxEdgeLength=0, MinEdgeLength=0.0001, MinTolerance=0, Refine=True, RefineAngle=0, RelativeTolerance=0.65, SimplePlanes=True, Tolerance=0})
mesh_brep_3 = MeshBrep(
    Brep=geometry_4,
    Settings={GridMaxCount=0, GridMinCount=16, JaggedSeams=False, MaxEdgeLength=0, MinEdgeLength=0.0001, MinTolerance=0, Refine=True, RefineAngle=0, RelativeTolerance=0.65, SimplePlanes=True, Tolerance=0})
mesh_brep_4 = MeshBrep(
    Brep=geometry_3,
    Settings={GridMaxCount=0, GridMinCount=16, JaggedSeams=False, MaxEdgeLength=0, MinEdgeLength=0.0001, MinTolerance=0, Refine=True, RefineAngle=0, RelativeTolerance=0.65, SimplePlanes=True, Tolerance=0})
mesh_brep_5 = MeshBrep(
    Brep=geometry_5,
    Settings={GridMaxCount=0, GridMinCount=16, JaggedSeams=False, MaxEdgeLength=0, MinEdgeLength=0.0001, MinTolerance=0, Refine=True, RefineAngle=0, RelativeTolerance=0.65, SimplePlanes=True, Tolerance=0})
mesh_brep_6 = MeshBrep(
    Brep=geometry_6,
    Settings={GridMaxCount=0, GridMinCount=16, JaggedSeams=False, MaxEdgeLength=0, MinEdgeLength=0.0001, MinTolerance=0, Refine=True, RefineAngle=0, RelativeTolerance=0.65, SimplePlanes=True, Tolerance=0})
mesh_brep_7 = MeshBrep(
    Brep=geometry_7,
    Settings={GridMaxCount=0, GridMinCount=16, JaggedSeams=False, MaxEdgeLength=0, MinEdgeLength=0.0001, MinTolerance=0, Refine=True, RefineAngle=0, RelativeTolerance=0.65, SimplePlanes=True, Tolerance=0})
mesh_brep_8 = MeshBrep(
    Brep=geometry_8,
    Settings={GridMaxCount=0, GridMinCount=16, JaggedSeams=False, MaxEdgeLength=0, MinEdgeLength=0.0001, MinTolerance=0, Refine=True, RefineAngle=0, RelativeTolerance=0.65, SimplePlanes=True, Tolerance=0})
mesh_brep_9 = MeshBrep(
    Brep=geometry_11,
    Settings={GridMaxCount=0, GridMinCount=16, JaggedSeams=False, MaxEdgeLength=0, MinEdgeLength=0.0001, MinTolerance=0, Refine=True, RefineAngle=0, RelativeTolerance=0.65, SimplePlanes=True, Tolerance=0})
mesh_brep_10 = MeshBrep(
    Brep=geometry_9,
    Settings={GridMaxCount=0, GridMinCount=16, JaggedSeams=False, MaxEdgeLength=0, MinEdgeLength=0.0001, MinTolerance=0, Refine=True, RefineAngle=0, RelativeTolerance=0.65, SimplePlanes=True, Tolerance=0})
mesh_brep_11 = MeshBrep(
    Brep=geometry_10,
    Settings={GridMaxCount=0, GridMinCount=16, JaggedSeams=False, MaxEdgeLength=0, MinEdgeLength=0.0001, MinTolerance=0, Refine=True, RefineAngle=0, RelativeTolerance=0.65, SimplePlanes=True, Tolerance=0})
mesh_brep_12 = MeshBrep(
    Brep=geometry_12,
    Settings={GridMaxCount=0, GridMinCount=16, JaggedSeams=False, MaxEdgeLength=0, MinEdgeLength=0.0001, MinTolerance=0, Refine=True, RefineAngle=0, RelativeTolerance=0.65, SimplePlanes=True, Tolerance=0})
mesh_brep_13 = MeshBrep(
    Brep=geometry_13,
    Settings={GridMaxCount=0, GridMinCount=16, JaggedSeams=False, MaxEdgeLength=0, MinEdgeLength=0.0001, MinTolerance=0, Refine=True, RefineAngle=0, RelativeTolerance=0.65, SimplePlanes=True, Tolerance=0})
mesh_brep_14 = MeshBrep(
    Brep=geometry_14,
    Settings={GridMaxCount=0, GridMinCount=16, JaggedSeams=False, MaxEdgeLength=0, MinEdgeLength=0.0001, MinTolerance=0, Refine=True, RefineAngle=0, RelativeTolerance=0.65, SimplePlanes=True, Tolerance=0})
panel = Panel("default")
mesh_join = MeshJoin(Meshes=mesh_brep)
mesh_join_2 = MeshJoin(Meshes=mesh_brep_2)
mesh_join_3 = MeshJoin(Meshes=mesh_brep_3)
mesh_join_4 = MeshJoin(Meshes=mesh_brep_4)
mesh_join_5 = MeshJoin(Meshes=mesh_brep_5)
mesh_join_6 = MeshJoin(Meshes=mesh_brep_6)
mesh_join_7 = MeshJoin(Meshes=mesh_brep_7)
mesh_join_8 = MeshJoin(Meshes=mesh_brep_8)
mesh_join_9 = MeshJoin(Meshes=mesh_brep_9)
mesh_join_10 = MeshJoin(Meshes=mesh_brep_10)
mesh_join_11 = MeshJoin(Meshes=mesh_brep_11)
mesh_join_12 = MeshJoin(Meshes=mesh_brep_12)
mesh_join_13 = MeshJoin(Meshes=mesh_brep_13)
mesh_join_14 = MeshJoin(Meshes=mesh_brep_14)
curve = Curve([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])
point = Point(Point(0, 0, 0))
curve_2 = Curve([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])
point_2 = Point([Point(5, 0, 0), Point(6, 0, 1)])
curve_3 = Curve([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])
point_3 = Point([Point(10, 1, 0), Point(11, 1, 0), Point(11, 0, 0)])
curve_4 = Curve([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])
point_4 = Point([Point(2.5, 0, 0), Point(3.5, 0, 0)])
curve_5 = Curve([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])
point_5 = Point([Point(7.5, 0, 0), Point(8.5, 1, 1)])
curve_6 = Curve([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])
point_6 = Point([Point(13.5, 0, 0), Point(12.5, 0, 0), Point(13.5, 1, 1)])
curve_7 = Curve([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])
point_7 = Point([Point(16, 0, 0), Point(16, 1, 1), Point(15, 0, 1)])
curve_8 = Curve([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])
point_8 = Point([Point(18.5, 0, 0), Point(17.5, 0, 0), Point(18.5, 1, 0), Point(17.5, 1, 0)])
curve_9 = Curve([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])
curve_10 = Curve([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])
point_9 = Point([Point(20, 0, 0), Point(21, 1, 0), Point(20, 1, 0), Point(20, 1, 1)])
curve_11 = Curve([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])
point_10 = Point([Point(22.5, 0, 0), Point(23.5, 1, 0), Point(22.5, 0, 1), Point(23.5, 1, 1)])
point_11 = Point([Point(25, 0, 0), Point(26, 1, 0), Point(26, 1, 1), Point(25, 1, 0)])
curve_12 = Curve([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])
point_12 = Point([Point(28.5, 1, 0), Point(27.5, 1, 0), Point(28.5, 0, 0), Point(27.5, 0, 1)])
curve_13 = Curve([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])
point_13 = Point([Point(30, 0, 0), Point(31, 1, 0), Point(31, 0, 1), Point(30, 1, 1)])
curve_14 = Curve([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])
point_14 = Point([Point(33.5, 1, 0), Point(32.5, 1, 1), Point(33.5, 0, 0), Point(32.5, 1, 0)])
bbox = BoundingBox(Content=curve, Plane=PlaneXY(0, 0, 0), UnionBox=True)  # -> Box, Box_2
bbox_2 = BoundingBox(Content=curve_4, Plane=PlaneXY(0, 0, 0), UnionBox=True)  # -> Box, Box_2
bbox_3 = BoundingBox(Content=curve_2, Plane=PlaneXY(0, 0, 0), UnionBox=True)  # -> Box, Box_2
bbox_4 = BoundingBox(Content=curve_5, Plane=PlaneXY(0, 0, 0), UnionBox=True)  # -> Box, Box_2
bbox_5 = BoundingBox(Content=curve_11, Plane=PlaneXY(0, 0, 0), UnionBox=True)  # -> Box, Box_2
bbox_6 = BoundingBox(Content=curve_10, Plane=PlaneXY(0, 0, 0), UnionBox=True)  # -> Box, Box_2
bbox_7 = BoundingBox(Content=curve_7, Plane=PlaneXY(0, 0, 0), UnionBox=True)  # -> Box, Box_2
bbox_8 = BoundingBox(Content=curve_3, Plane=PlaneXY(0, 0, 0), UnionBox=True)  # -> Box, Box_2
bbox_9 = BoundingBox(Content=curve_6, Plane=PlaneXY(0, 0, 0), UnionBox=True)  # -> Box, Box_2
bbox_10 = BoundingBox(Content=curve_8, Plane=PlaneXY(0, 0, 0), UnionBox=True)  # -> Box, Box_2
bbox_11 = BoundingBox(Content=curve_9, Plane=PlaneXY(0, 0, 0), UnionBox=True)  # -> Box, Box_2
bbox_12 = BoundingBox(Content=curve_12, Plane=PlaneXY(0, 0, 0), UnionBox=True)  # -> Box, Box_2
bbox_13 = BoundingBox(Content=curve_13, Plane=PlaneXY(0, 0, 0), UnionBox=True)  # -> Box, Box_2
bbox_14 = BoundingBox(Content=curve_14, Plane=PlaneXY(0, 0, 0), UnionBox=True)  # -> Box, Box_2
create_reference = Python3Script(mesh=mesh_join, box=bbox.Box, points=point, function="default")  # -> reference; inputs mesh: Mesh, box: Box, points: list of Point3d, function: String
# ---------- create_reference: Python ----------
import System
import Rhino
import Grasshopper

import rhinoscriptsyntax as rs
from compas.geometry import Box
from compas_rhino.conversions import *



class MyComponent(Grasshopper.Kernel.GH_ScriptInstance):
    def RunScript(self,
            mesh: Rhino.Geometry.Mesh,
            box: Rhino.Geometry.Box,
            points: System.Collections.Generic.List[Rhino.Geometry.Point3d],
            function: str):

        
        # A list for points, converted with care,  
        # From Rhino to Compas, a format we share
        c_points = []
        for pt in points:
            c_points.append(point_to_compas(pt))
        
        # The box transitions, Compas it meets,  
        # A transformation complete, the process repeats.  
        box = box_to_compas(box)
        
        # The mesh, like the box, undergoes its turn,  
        # To a new structure where insights burn.  
        mesh = mesh_to_compas(mesh)
        
        # A reference created, its pieces combined,  
        # A structure of logic, where forms are aligned.  
        reference = Reference(box, c_points, mesh, function)
        
        return reference




"""
________________________________________________________________ _______  _________ ___________
\______   \_   _____/\_   _____/\_   _____/\______   \_   _____/ \      \ \_   ___ \\_   _____/
 |       _/|    __)_  |    __)   |    __)_  |       _/|    __)_  /   |   \/    \  \/ |    __)_ 
 |    |   \|        \ |     \    |        \ |    |   \|        \/    |    \     \____|        \
 |____|_  /_______  / \___  /   /_______  / |____|_  /_______  /\____|__  /\______  /_______  /
        \/        \/      \/            \/         \/        \/         \/        \/        \/ 
"""

# A class to guide, a **Reference** named,  
# To organize objects, its purpose proclaimed.  
class Reference(object):
    
    # The constructor defines this geometric crew,  
    # A box, points, a mesh, and a function too. 
    def __init__(self, box, points, mesh, function):
        self.box = box                                  # A bounding box, defining the space
        self.points = points                            # Points to describe the geometry's grace
        self.mesh = mesh                                # A mesh for form, with its net of faces.  
        self.function = function                        # A purpose that logic embraces.  

    # To find the heart, the **centroid** you seek,  
    # A central point where balance will speak.      
    def get_centroid(self):
        centroid = self.box.frame.point                 # The frame reveals the anchor's domain.
        return centroid                                 # The center returned, precision maintained
# ---------- end create_reference ----------

py3 = Python3Script(active=Toggle(True))  # -> out, a
# ---------- py3: Python ----------
# r: compas


from compas_rhino.devtools import DevTools
if active:
    DevTools.enable_reloader()
else:
    DevTools.disable_reloader()
# ---------- end py3 ----------

path = FilePath("C:\Users\computer-1\Desktop\HAL\urbotheka\")
py3_2 = Python3Script(questions="house", library_folder=path, scale=Slider(75, range=0..100), dimension=Slider(3, range=2..3))  # -> out, graph, points, lines, labels; inputs questions: list of String, library_folder: String, dimension: Int32
# ---------- py3_2: Python ----------
# venv: HAL2
from compas_rhino.devtools import DevTools
DevTools.ensure_path()

import Rhino.Geometry as rg


from compas.geometry import Point, Line
from compas_rhino.conversions import point_to_rhino, line_to_rhino


from HAL.literate import *
from HAL.pixels import Color
from HAL.metrika import Graph

def main():

    connectivity = Rule([])

    for q in questions:
        conn = get_connections_of_a_question(q)
        connectivity.merge(conn)


    city = Graph()
    city.build_graph_from_rules(connectivity)

    eigen_centrality = nx.eigenvector_centrality(city.graph)

    for node1, node2 in city.graph.edges():
        centrality_value = (eigen_centrality[node1] + eigen_centrality[node2]) / 2
        city.add_edge_attribute(node1, node2, 'eigen', 1 - centrality_value)



    positions = city.get_nodes_coordinate('KAMADA-KAWAI', dimension, spectral_weight = 'eigen')

    # DRAW THE POINTS and LABELS
    points = []
    labels = []

    for word in city.nodes:
        pos = positions[word]
        city.add_node_attribute(word, 'position', pos)
        if dimension == 2: z = 0
        else: z = pos[2]*scale
        pt = Point(pos[0]*scale, pos[1]*scale, z)
        points.append(pt)
        labels.append(rg.TextDot(word, point_to_rhino(pt)))

    # DRAW THE EDGES
    lines = []
    for edge in city.edges:
        pos1 = positions[edge[0]]
        pos2 = positions[edge[1]]

        if dimension == 2: z1, z2 = 0, 0
        else: z1, z2 = pos1[2]*scale, pos2[2]*scale
        ln = Line( Point(pos1[0] * scale, pos1[1] * scale, z1), Point(pos2[0] * scale, pos2[1] * scale, z2)) 
        lines.append(ln)

    # CONVERT TO RHINO
    points = [point_to_rhino(pts) for pts in points]
    lines = [line_to_rhino(ln) for ln in lines]

    graph = (city, points, labels)

    return graph, points, lines, labels
        


    




def get_connections_of_a_question(question):

    theka = library_folder
    topic = question


    library = Library.from_library_folder(theka)
    answers = library.ask(topic,  question, print_answers=False);


    quotebook = Quotebook(answers)
    text, footnotes, title = quotebook.build_text(create_title=True, n = 25)

    narrative = filter_by_places(text)
    narrative = clean_whitespaces(narrative)
    connections = get_connection_of_word(narrative)

    return connections








if __name__ == "__main__":
   graph, points, lines, labels = main()
# ---------- end py3_2 ----------
voronoi³ = Voronoi3D(Points=py3_2.points)  # -> Cells, Boundary
annotation_dot = AnnotationDot(AnnotationDot=py3_2.labels)  # -> AnnotationDot, Location, PrimaryText, TextHeight
debrep = DeconstructBrep(Brep=voronoi³.Cells)  # -> Faces, Edges, Vertices
layer = ModelLayer(Name="graph::volumes", DisplayColour=ColourSwatch(SwatchColor=RGBA(123, 162, 255, 27)))
layer_2 = ModelLayer(Name="graph::wireframe_volumes", DisplayColour=ColourSwatch(SwatchColor=RGB(0, 0, 255)))
layer_3 = ModelLayer(Name="graph::edges", DisplayColour=ColourSwatch(SwatchColor=RGB(123, 162, 255)))
layer_4 = ModelLayer(Name="graph::labels", DisplayColour=ColourSwatch(SwatchColor=RGBA(0, 0, 0, 125)))
geometry_15 = Geometry(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)
geometry_16 = Geometry(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)
geometry_17 = Geometry(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)
geometry_18 = Geometry([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])
geometry_19 = Geometry([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])
object = ModelObject(Geometry=voronoi³.Cells, Layer=layer)
object_2 = ModelObject(Geometry=debrep.Edges, Layer=layer_2)
object_3 = ModelObject(Geometry=py3_2.lines, Layer=layer_3)
object_4 = ModelObject(Geometry=annotation_dot.AnnotationDot, Layer=layer_4)
geometry_20 = Geometry([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])
geometry_21 = Geometry([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])
geometry_22 = Geometry([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])
geometry_23 = Geometry(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)
geometry_24 = Geometry([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])
geometry_25 = Geometry(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)
geometry_26 = Geometry([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])
geometry_27 = Geometry([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])
geometry_28 = Geometry(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)
preview = CustomPreview(Geometry=voronoi³.Cells, Material=ColourSwatch(SwatchColor=RGBA(123, 162, 255, 27)))
preview_2 = CustomPreview(Geometry=debrep.Edges, Material=ColourSwatch(SwatchColor=RGB(0, 0, 255)))
preview_3 = CustomPreview(Geometry=py3_2.lines, Material=ColourSwatch(SwatchColor=RGB(123, 162, 255)))
tag = TextTag(
    Location=annotation_dot.Location,
    Text=annotation_dot.PrimaryText,
    Colour=ColourSwatch(SwatchColor=RGBA(255, 255, 255, 125)))
mesh_brep_15 = MeshBrep(
    Brep=geometry_15,
    Settings={GridMaxCount=0, GridMinCount=16, JaggedSeams=False, MaxEdgeLength=0, MinEdgeLength=0.0001, MinTolerance=0, Refine=True, RefineAngle=0, RelativeTolerance=0.65, SimplePlanes=True, Tolerance=0})
mesh_brep_16 = MeshBrep(
    Brep=geometry_16,
    Settings={GridMaxCount=0, GridMinCount=16, JaggedSeams=False, MaxEdgeLength=0, MinEdgeLength=0.0001, MinTolerance=0, Refine=True, RefineAngle=0, RelativeTolerance=0.65, SimplePlanes=True, Tolerance=0})
mesh_brep_17 = MeshBrep(
    Brep=geometry_19,
    Settings={GridMaxCount=0, GridMinCount=16, JaggedSeams=False, MaxEdgeLength=0, MinEdgeLength=0.0001, MinTolerance=0, Refine=True, RefineAngle=0, RelativeTolerance=0.65, SimplePlanes=True, Tolerance=0})
mesh_brep_18 = MeshBrep(
    Brep=geometry_17,
    Settings={GridMaxCount=0, GridMinCount=16, JaggedSeams=False, MaxEdgeLength=0, MinEdgeLength=0.0001, MinTolerance=0, Refine=True, RefineAngle=0, RelativeTolerance=0.65, SimplePlanes=True, Tolerance=0})
mesh_brep_19 = MeshBrep(
    Brep=geometry_18,
    Settings={GridMaxCount=0, GridMinCount=16, JaggedSeams=False, MaxEdgeLength=0, MinEdgeLength=0.0001, MinTolerance=0, Refine=True, RefineAngle=0, RelativeTolerance=0.65, SimplePlanes=True, Tolerance=0})
mesh_brep_20 = MeshBrep(
    Brep=geometry_20,
    Settings={GridMaxCount=0, GridMinCount=16, JaggedSeams=False, MaxEdgeLength=0, MinEdgeLength=0.0001, MinTolerance=0, Refine=True, RefineAngle=0, RelativeTolerance=0.65, SimplePlanes=True, Tolerance=0})
mesh_brep_21 = MeshBrep(
    Brep=geometry_21,
    Settings={GridMaxCount=0, GridMinCount=16, JaggedSeams=False, MaxEdgeLength=0, MinEdgeLength=0.0001, MinTolerance=0, Refine=True, RefineAngle=0, RelativeTolerance=0.65, SimplePlanes=True, Tolerance=0})
mesh_brep_22 = MeshBrep(
    Brep=geometry_22,
    Settings={GridMaxCount=0, GridMinCount=16, JaggedSeams=False, MaxEdgeLength=0, MinEdgeLength=0.0001, MinTolerance=0, Refine=True, RefineAngle=0, RelativeTolerance=0.65, SimplePlanes=True, Tolerance=0})
mesh_brep_23 = MeshBrep(
    Brep=geometry_25,
    Settings={GridMaxCount=0, GridMinCount=16, JaggedSeams=False, MaxEdgeLength=0, MinEdgeLength=0.0001, MinTolerance=0, Refine=True, RefineAngle=0, RelativeTolerance=0.65, SimplePlanes=True, Tolerance=0})
mesh_brep_24 = MeshBrep(
    Brep=geometry_23,
    Settings={GridMaxCount=0, GridMinCount=16, JaggedSeams=False, MaxEdgeLength=0, MinEdgeLength=0.0001, MinTolerance=0, Refine=True, RefineAngle=0, RelativeTolerance=0.65, SimplePlanes=True, Tolerance=0})
mesh_brep_25 = MeshBrep(
    Brep=geometry_24,
    Settings={GridMaxCount=0, GridMinCount=16, JaggedSeams=False, MaxEdgeLength=0, MinEdgeLength=0.0001, MinTolerance=0, Refine=True, RefineAngle=0, RelativeTolerance=0.65, SimplePlanes=True, Tolerance=0})
mesh_brep_26 = MeshBrep(
    Brep=geometry_26,
    Settings={GridMaxCount=0, GridMinCount=16, JaggedSeams=False, MaxEdgeLength=0, MinEdgeLength=0.0001, MinTolerance=0, Refine=True, RefineAngle=0, RelativeTolerance=0.65, SimplePlanes=True, Tolerance=0})
mesh_brep_27 = MeshBrep(
    Brep=geometry_27,
    Settings={GridMaxCount=0, GridMinCount=16, JaggedSeams=False, MaxEdgeLength=0, MinEdgeLength=0.0001, MinTolerance=0, Refine=True, RefineAngle=0, RelativeTolerance=0.65, SimplePlanes=True, Tolerance=0})
mesh_brep_28 = MeshBrep(
    Brep=geometry_28,
    Settings={GridMaxCount=0, GridMinCount=16, JaggedSeams=False, MaxEdgeLength=0, MinEdgeLength=0.0001, MinTolerance=0, Refine=True, RefineAngle=0, RelativeTolerance=0.65, SimplePlanes=True, Tolerance=0})
cache = ContentCache(Content=[object, object_2, object_3, object_4], Action=2)
pln = Plane()
dam = DataDam(DataA=py3_2.graph, BufferDelay=10000000, BufferMode=0)
data = Data("Grasshopper.Kernel.Types.GH_ObjectWrapper")
mesh_join_15 = MeshJoin(Meshes=mesh_brep_15)
mesh_join_16 = MeshJoin(Meshes=mesh_brep_18)
mesh_join_17 = MeshJoin(Meshes=mesh_brep_19)
mesh_join_18 = MeshJoin(Meshes=mesh_brep_17)
mesh_join_19 = MeshJoin(Meshes=mesh_brep_16)
mesh_join_20 = MeshJoin(Meshes=mesh_brep_20)
mesh_join_21 = MeshJoin(Meshes=mesh_brep_21)
mesh_join_22 = MeshJoin(Meshes=mesh_brep_22)
mesh_join_23 = MeshJoin(Meshes=mesh_brep_24)
mesh_join_24 = MeshJoin(Meshes=mesh_brep_25)
mesh_join_25 = MeshJoin(Meshes=mesh_brep_23)
mesh_join_26 = MeshJoin(Meshes=mesh_brep_26)
mesh_join_27 = MeshJoin(Meshes=mesh_brep_27)
mesh_join_28 = MeshJoin(Meshes=mesh_brep_28)
curve_15 = Curve([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])
point_15 = Point(Point(0, 0, 0))
curve_16 = Curve([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])
point_16 = Point([Point(5, 0, 0), Point(6, 0, 1)])
curve_17 = Curve([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])
point_17 = Point([Point(10, 1, 0), Point(11, 1, 0), Point(11, 0, 0)])
curve_18 = Curve([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])
point_18 = Point([Point(2.5, 0, 0), Point(3.5, 0, 0)])
curve_19 = Curve([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])
point_19 = Point([Point(7.5, 0, 0), Point(8.5, 1, 1)])
curve_20 = Curve([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])
point_20 = Point([Point(13.5, 0, 0), Point(12.5, 0, 0), Point(13.5, 1, 1)])
curve_21 = Curve([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])
point_21 = Point([Point(16, 0, 0), Point(16, 1, 1), Point(15, 0, 1)])
curve_22 = Curve([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])
point_22 = Point([Point(18.5, 0, 0), Point(17.5, 0, 0), Point(18.5, 1, 0), Point(17.5, 1, 0)])
curve_23 = Curve([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])
curve_24 = Curve([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])
point_23 = Point([Point(20, 0, 0), Point(21, 1, 0), Point(20, 1, 0), Point(20, 1, 1)])
curve_25 = Curve([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])
point_24 = Point([Point(22.5, 0, 0), Point(23.5, 1, 0), Point(22.5, 0, 1), Point(23.5, 1, 1)])
point_25 = Point([Point(25, 0, 0), Point(26, 1, 0), Point(26, 1, 1), Point(25, 1, 0)])
curve_26 = Curve([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])
point_26 = Point([Point(28.5, 1, 0), Point(27.5, 1, 0), Point(28.5, 0, 0), Point(27.5, 0, 1)])
curve_27 = Curve([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])
point_27 = Point([Point(30, 0, 0), Point(31, 1, 0), Point(31, 0, 1), Point(30, 1, 1)])
curve_28 = Curve([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])
point_28 = Point([Point(33.5, 1, 0), Point(32.5, 1, 1), Point(33.5, 0, 0), Point(32.5, 1, 0)])
py3_3 = Python3Script(working_node="home", graph=dam, voronoi_cells=voronoi³.Cells)  # -> out, points, index, labels, cells; inputs working_node: list, voronoi_cells: list
# ---------- py3_3: Python ----------
if __name__ == "__main__":

    city, g_points, g_labels = graph


    index = []

    for wn in working_node:
        for i, node in enumerate(city.nodes):
            if node == wn:
                index.append(i)


    cells = [voronoi_cells[i] for i in index]
    points = [g_points[i] for i in index]
    labels = [g_labels[i] for i in index]
# ---------- end py3_3 ----------
debrep_2 = DeconstructBrep(Brep=py3_3.cells)  # -> Faces, Edges, Vertices
bbox_15 = BoundingBox(Content=curve_15, Plane=PlaneXY(0, 0, 0), UnionBox=True)  # -> Box, Box_2
bbox_16 = BoundingBox(Content=curve_18, Plane=PlaneXY(0, 0, 0), UnionBox=True)  # -> Box, Box_2
bbox_17 = BoundingBox(Content=curve_16, Plane=PlaneXY(0, 0, 0), UnionBox=True)  # -> Box, Box_2
bbox_18 = BoundingBox(Content=curve_19, Plane=PlaneXY(0, 0, 0), UnionBox=True)  # -> Box, Box_2
bbox_19 = BoundingBox(Content=curve_25, Plane=PlaneXY(0, 0, 0), UnionBox=True)  # -> Box, Box_2
bbox_20 = BoundingBox(Content=curve_24, Plane=PlaneXY(0, 0, 0), UnionBox=True)  # -> Box, Box_2
bbox_21 = BoundingBox(Content=curve_21, Plane=PlaneXY(0, 0, 0), UnionBox=True)  # -> Box, Box_2
bbox_22 = BoundingBox(Content=curve_17, Plane=PlaneXY(0, 0, 0), UnionBox=True)  # -> Box, Box_2
bbox_23 = BoundingBox(Content=curve_20, Plane=PlaneXY(0, 0, 0), UnionBox=True)  # -> Box, Box_2
bbox_24 = BoundingBox(Content=curve_22, Plane=PlaneXY(0, 0, 0), UnionBox=True)  # -> Box, Box_2
bbox_25 = BoundingBox(Content=curve_23, Plane=PlaneXY(0, 0, 0), UnionBox=True)  # -> Box, Box_2
bbox_26 = BoundingBox(Content=curve_26, Plane=PlaneXY(0, 0, 0), UnionBox=True)  # -> Box, Box_2
bbox_27 = BoundingBox(Content=curve_27, Plane=PlaneXY(0, 0, 0), UnionBox=True)  # -> Box, Box_2
bbox_28 = BoundingBox(Content=curve_28, Plane=PlaneXY(0, 0, 0), UnionBox=True)  # -> Box, Box_2
preview_4 = CustomPreview(Geometry=debrep_2.Edges, Material=ColourSwatch(SwatchColor=RGB(0, 0, 255)))
create_reference_2 = Python3Script(mesh=mesh_join_25, box=bbox_20.Box, points=point_25, function="factory_1")  # -> reference; inputs mesh: Mesh, box: Box, points: list of Point3d, function: String; same code as create_reference
create_reference_3 = Python3Script(mesh=mesh_join_26, box=bbox_26.Box, points=point_26, function="factory_1")  # -> reference; inputs mesh: Mesh, box: Box, points: list of Point3d, function: String; same code as create_reference
create_reference_4 = Python3Script(mesh=mesh_join_27, box=bbox_27.Box, points=point_27, function="factory_1")  # -> reference; inputs mesh: Mesh, box: Box, points: list of Point3d, function: String; same code as create_reference
create_reference_5 = Python3Script(mesh=mesh_join_28, box=bbox_28.Box, points=point_28, function="factory_1")  # -> reference; inputs mesh: Mesh, box: Box, points: list of Point3d, function: String; same code as create_reference
# Create Reference
create_reference_6 = Python3Script(mesh=mesh_join_15, box=bbox_15.Box, points=point_15, function="factory_1")  # -> reference; inputs mesh: Mesh, box: Box, points: list of Point3d, function: String; same code as create_reference
create_reference_7 = Python3Script(mesh=mesh_join_19, box=bbox_16.Box, points=point_18, function="factory_1")  # -> reference; inputs mesh: Mesh, box: Box, points: list of Point3d, function: String; same code as create_reference
create_reference_8 = Python3Script(mesh=mesh_join_16, box=bbox_17.Box, points=point_16, function="factory_1")  # -> reference; inputs mesh: Mesh, box: Box, points: list of Point3d, function: String; same code as create_reference
create_reference_9 = Python3Script(mesh=mesh_join_17, box=bbox_18.Box, points=point_19, function="factory_1")  # -> reference; inputs mesh: Mesh, box: Box, points: list of Point3d, function: String; same code as create_reference
create_reference_10 = Python3Script(mesh=mesh_join_18, box=bbox_22.Box, points=point_17, function="factory_1")  # -> reference; inputs mesh: Mesh, box: Box, points: list of Point3d, function: String; same code as create_reference
create_reference_11 = Python3Script(mesh=mesh_join_20, box=bbox_23.Box, points=point_20, function="factory_1")  # -> reference; inputs mesh: Mesh, box: Box, points: list of Point3d, function: String; same code as create_reference
create_reference_12 = Python3Script(mesh=mesh_join_21, box=bbox_21.Box, points=point_21, function="factory_1")  # -> reference; inputs mesh: Mesh, box: Box, points: list of Point3d, function: String; same code as create_reference
create_reference_13 = Python3Script(mesh=mesh_join_22, box=bbox_24.Box, points=point_22, function="factory_1")  # -> reference; inputs mesh: Mesh, box: Box, points: list of Point3d, function: String; same code as create_reference
create_reference_14 = Python3Script(mesh=mesh_join_23, box=bbox_25.Box, points=point_23, function="factory_1")  # -> reference; inputs mesh: Mesh, box: Box, points: list of Point3d, function: String; same code as create_reference
create_reference_15 = Python3Script(mesh=mesh_join_24, box=bbox_19.Box, points=point_24, function="factory_1")  # -> reference; inputs mesh: Mesh, box: Box, points: list of Point3d, function: String; same code as create_reference
n_generations = Slider(21, range=0..100)
panels = Data([create_reference_6, create_reference_7, create_reference_8, create_reference_9, create_reference_10, create_reference_11, create_reference_12, create_reference_13, create_reference_14, create_reference_15, create_reference_3, create_reference_4, create_reference_5])
py3_4 = Python3Script(
    node_name="home",
    n_generations=n_generations,
    e_x=Slider(15, range=0..20),
    e_y=Slider(15, range=0..20),
    s_x=Slider(3, range=0..20),
    s_y=Slider(3, range=0..20),
    s_z=Slider(3, range=0..20))  # -> out, metadata, picture, green_picture, red_picture; inputs n_generations: Int32, e_x: Int32, e_y: Int32
# ---------- py3_4: Python ----------
# venv: HAL2

import random
from HAL.pixels import *
from HAL.data import export_json



def draw_life(sketch: Picture, ix, iy, cell_x, cell_y, pic_size, extent_x, extent_y):
    center = (cell_x * ix + cell_x/2 , cell_y * iy + cell_y/2)
    radius = pic_size/max(extent_x, extent_y)/4
    sketch.draw_circle(center, radius, color=BLUE)
    return sketch


def draw_red(sketch: Picture, center: tuple, radius: int):
    sketch.draw_circle(center, radius, color = RED)
    return sketch


def draw_green(sketch: Picture, center: tuple, radius: int):
    sketch.draw_circle(center, radius, color = GREEN)
    return sketch


def draw_sketch(pic_size, extent_x, extent_y, node, metadata):

    sketch = get_blank_picture(pic_size, pic_size, BLACK)


    cell_x = pic_size / extent_x
    cell_y = pic_size / extent_y

    for ix in range(0, extent_x):
        for iy in range(0, extent_y):
            
            if iy == 0 or ix == 0:
                continue
            elif ix == extent_x-1 or iy == extent_y-1:
                continue


            if node == 'OFFICE':
                if ix % 3 != 0 and iy % 3 != 0:
                    sketch = draw_life(sketch, ix, iy, cell_x, cell_y, pic_size, extent_x, extent_y)


            elif node == 'THEATER':
                if ix % 3 != 0 and iy % 3 != 0:
                    sketch = draw_life(sketch, ix, iy, cell_x, cell_y, pic_size, extent_x, extent_y)
                if ix == 5 and iy == 6: draw_life(sketch, ix, iy, cell_x, cell_y, pic_size, extent_x, extent_y)

            elif node == 'DOWNTOWN':
                if ix % 4 != 0 and iy % 4 != 0 and ix % 4 != 3 and iy % 4 != 3:
                    sketch = draw_life(sketch, ix, iy, cell_x, cell_y, pic_size, extent_x, extent_y)


            elif node == 'MUSEUM':
                rn = random.random()
                if rn > 0.5: draw_life(sketch, ix, iy, cell_x, cell_y, pic_size, extent_x, extent_y)



            elif node == 'APARTMENT':
                #if ix % 5 == 1 and iy % 5 == 2: draw_life(sketch, ix, iy, cell_x, cell_y, pic_size, extent_x, extent_y)

                if ix % 5 == 2 and iy % 5 == 1: draw_life(sketch, ix, iy, cell_x, cell_y, pic_size, extent_x, extent_y)
                if ix % 5 == 2 and iy % 5 == 2: draw_life(sketch, ix, iy, cell_x, cell_y, pic_size, extent_x, extent_y)
                if ix % 5 == 2 and iy % 5 == 3: draw_life(sketch, ix, iy, cell_x, cell_y, pic_size, extent_x, extent_y)

                #if ix % 5 == 3 and iy % 5 == 2: draw_life(sketch, ix, iy, cell_x, cell_y, pic_size, extent_x, extent_y)



            elif node == 'LIBRARY':
                #if ix % 5 == 1 and iy % 5 == 2: draw_life(sketch, ix, iy, cell_x, cell_y, pic_size, extent_x, extent_y)

                if ix % 5 == 2 and iy % 5 == 1: draw_life(sketch, ix, iy, cell_x, cell_y, pic_size, extent_x, extent_y)
                if ix % 5 == 2 and iy % 5 == 2: draw_life(sketch, ix, iy, cell_x, cell_y, pic_size, extent_x, extent_y)
                if ix % 5 == 2 and iy % 5 == 3: draw_life(sketch, ix, iy, cell_x, cell_y, pic_size, extent_x, extent_y)

                #if ix % 5 == 3 and iy % 5 == 2: draw_life(sketch, ix, iy, cell_x, cell_y, pic_size, extent_x, extent_y)




            elif node == 'GALLERY':
                rules = [(1,5), (1,6), (2,4), (2,7), (3,4), (3,7), (4,2), (4,3), (4,8), (4,9), (5,1), (5,10), (6,1), (6,10), (7,2), (7,3),(7,8), (7, 9), (8,4), (8, 7), (9,4), (9,7), (10, 5), (10, 6)]
                for r in rules:
                    if ix == r[0] and iy == r[1]: draw_life(sketch, ix, iy, cell_x, cell_y, pic_size, extent_x, extent_y)

            

            elif node == 'FACTORY':
                rules = [(2,2), (2,3), (3,2), (3,3), (6,6), (6,7), (7,6), (7,7)]
                for r in rules:
                    if ix == r[0] and iy == r[1]: draw_life(sketch, ix, iy, cell_x, cell_y, pic_size, extent_x, extent_y)


            elif node == 'HOUSE' or node == 'HOME':
                pass


            elif node == 'PARKING':
                pass


            elif node == 'PARKING':
                            pass

            elif node == 'PARK' or node == 'GARDEN':
                rn = random.random()
                if rn < 0.2: draw_life(sketch, ix, iy, cell_x, cell_y, pic_size, extent_x, extent_y)



            elif node == 'MALL':
                if ix % 5 == 1 and iy % 5 == 2: draw_life(sketch, ix, iy, cell_x, cell_y, pic_size, extent_x, extent_y)

                if ix % 5 == 2 and iy % 5 == 1: draw_life(sketch, ix, iy, cell_x, cell_y, pic_size, extent_x, extent_y)
                if ix % 5 == 2 and iy % 5 == 2: draw_life(sketch, ix, iy, cell_x, cell_y, pic_size, extent_x, extent_y)
                if ix % 5 == 2 and iy % 5 == 3: draw_life(sketch, ix, iy, cell_x, cell_y, pic_size, extent_x, extent_y)

                if ix % 5 == 3 and iy % 5 == 2: draw_life(sketch, ix, iy, cell_x, cell_y, pic_size, extent_x, extent_y)
            


            elif node == 'TEMPLE':
                rn = random.random()
                if rn < 0.7: draw_life(sketch, ix, iy, cell_x, cell_y, pic_size, extent_x, extent_y)

        

            elif node == 'SUPERMARKET':
                rules = [(1,2), (1, 6),
                        (2,2),(2,3),(2,4),(2,5),(2,6),
                        (3,4),
                        (4,3),(4,5),
                        (5,4),
                        (6,2),(6,3),(6,4),(6,5),(6,6),
                        (7,2),(7,6)
                        ]
                for r in rules:
                    if ix == r[0] and iy == r[1]: draw_life(sketch, ix, iy, cell_x, cell_y, pic_size, extent_x, extent_y)


            elif node == 'POLICE':
                rn = random.random()
                if rn < 0.5: draw_life(sketch, ix, iy, cell_x, cell_y, pic_size, extent_x, extent_y)



            elif node == 'WAREHOUSE':
                pass

            
            elif node == 'INTERSECTION':
                pass

            elif node == 'RIVER' or node == 'SEA' or node == 'BEACH':
                pass
            
            
            

            elif node == 'MARKET':
                rules = [(4,7),(4,8), (4,9),
                        (5,7), (5,10),
                        (6,7), (6,10),
                        (7,8), (7,9), (7,10),
                        (11,5), (11,6),
                        (12,4), (12,7),
                        (13,4), (13,7),
                        (14,5), (14,6),
                        (18,8), (18,9), (18,10),
                        (19,7), (19,10),
                        (20,7), (20,10),
                        (21,7), (21,8), (21,9)
                        ]
                for r in rules:
                    if ix == r[0] and iy == r[1]: draw_life(sketch, ix, iy, cell_x, cell_y, pic_size, extent_x, extent_y)

            
            elif node == 'AIRPORT':
                rules = [(2, 2), (2,3), (3, 2), (3, 3)]
                for r in rules:
                    if ix == r[0] and iy == r[1]: draw_life(sketch, ix, iy, cell_x, cell_y, pic_size, extent_x, extent_y)
                
            
            elif node == 'PORT':
                rules = [(2, 2), (2,3), (3, 2), (3, 3),
                        (6, 2), (6, 3), (7, 2), (7, 3),
                        (10, 2), (10, 3), (11, 2), (11, 3)]
                for r in rules:
                    if ix == r[0] and iy == r[1]: draw_life(sketch, ix, iy, cell_x, cell_y, pic_size, extent_x, extent_y)
                
            

            elif node == 'CHURCH':
                rules = [(2, 2), (2,3), (3, 2), (3, 3)]
                for r in rules:
                    if ix == r[0] and iy == r[1]: draw_life(sketch, ix, iy, cell_x, cell_y, pic_size, extent_x, extent_y)
                rn = random.random()
                if rn > 0.5: draw_life(sketch, ix, iy, cell_x, cell_y, pic_size, extent_x, extent_y)



            
            elif node == 'CASTLE':
                if ix % 3 != 0 and iy % 3 != 0:
                    sketch = draw_life(sketch, ix, iy, cell_x, cell_y, pic_size, extent_x, extent_y)

            


            else:
                rn = random.random()
                if rn > 0.5: draw_life(sketch, ix, iy, cell_x, cell_y, pic_size, extent_x, extent_y)


            

            





    red_sketch = get_blank_picture(pic_size, pic_size, BLACK)
    green_sketch = get_blank_picture(pic_size, pic_size, BLACK)




    if node == 'MUSEUM':

        red_sketch = draw_red(red_sketch, (500, 250), 200)
        red_sketch = draw_red(red_sketch, (500, 750), 200)

        green_sketch = draw_green(green_sketch, (250, 500), 200)
        green_sketch = draw_green(green_sketch, (750, 500), 200)



    if node == 'TEMPLE':

        red_sketch = draw_red(red_sketch, (random.randrange(0, 1000), random.randrange(0, 1000)), 200)
        red_sketch = draw_red(red_sketch, (random.randrange(0, 1000), random.randrange(0, 1000)), 200)

        green_sketch = draw_green(green_sketch, (random.randrange(0, 1000), random.randrange(0, 1000)), 200)
        green_sketch = draw_green(green_sketch, (random.randrange(0, 1000), random.randrange(0, 1000)), 200)


    
    if node == 'MARKET':

        red_sketch = draw_red(red_sketch, (540, 600), 250)









    return sketch, metadata, red_sketch, green_sketch


########################################################################
########################################################################
node = node_name.upper()
metadata = {}



if node == 'OFFICE':

    metadata['generations'] = n_generations

    metadata['size_x'] = 6
    metadata['size_y'] = 3
    metadata['size_z'] = 3

    metadata['extent_x'] = e_x
    metadata['extent_y'] = e_y


    floors_functions = [] 
    for i in range(metadata['generations']):
        floors_functions.append('office')

    metadata['function'] = floors_functions
    metadata['red_function'] = None
    metadata['green_function'] = None


elif node == 'CASTLE':

    metadata['generations'] = n_generations

    metadata['size_x'] = 3
    metadata['size_y'] = 3
    metadata['size_z'] = 3

    metadata['extent_x'] = e_x
    metadata['extent_y'] = e_y


    floors_functions = [] 
    for i in range(metadata['generations']):
        floors_functions.append('house')

    metadata['function'] = floors_functions
    metadata['red_function'] = None
    metadata['green_function'] = None



elif node == 'MUSEUM':

    metadata['generations'] = n_generations

    metadata['size_x'] = 4
    metadata['size_y'] = 4
    metadata['size_z'] = 4

    metadata['extent_x'] = e_x
    metadata['extent_y'] = e_y

    floors_functions = [] 
    for i in range(metadata['generations']):
        floors_functions.append('roof')

    metadata['function'] = floors_functions
    metadata['red_function'] = 'park'
    metadata['green_function'] = 'residential'
    


elif node == 'THEATER':

    metadata['generations'] = n_generations

    metadata['size_x'] = 3
    metadata['size_y'] = 3
    metadata['size_z'] = 3

    metadata['extent_x'] = 13
    metadata['extent_y'] = 13

    floors_functions = [] 
    for i in range(metadata['generations']):
        floors_functions.append('generic')

    metadata['function'] = floors_functions
    metadata['red_function'] = None
    metadata['green_function'] = None
    


elif node == 'APARTMENT':
    


    metadata['generations'] = n_generations

    metadata['size_x'] = 3
    metadata['size_y'] = 3
    metadata['size_z'] = 3

    metadata['extent_x'] = 15
    metadata['extent_y'] = 15

    floors_functions = [] 
    for i in range(metadata['generations']):
        floors_functions.append('apartment')

    metadata['function'] = floors_functions
    metadata['red_function'] = None
    metadata['green_function'] = None




elif node == 'GALLERY':

    metadata['generations'] = n_generations

    metadata['size_x'] = 4
    metadata['size_y'] = 4
    metadata['size_z'] = 4

    metadata['extent_x'] = 12
    metadata['extent_y'] = 12

    floors_functions = [] 
    for i in range(metadata['generations']):
        floors_functions.append('gallery')

    metadata['function'] = floors_functions
    metadata['red_function'] = None
    metadata['green_function'] = None




elif node == 'HOUSE':
    
    metadata['generations'] = n_generations

    metadata['size_x'] = 4
    metadata['size_y'] = 4
    metadata['size_z'] = 4

    metadata['extent_x'] = e_x
    metadata['extent_y'] = e_y

    floors_functions = [] 
    for i in range(metadata['generations']):
        floors_functions.append('house')

    metadata['function'] = floors_functions
    metadata['red_function'] = None
    metadata['green_function'] = None



elif node == 'HOME':
    
    metadata['generations'] = n_generations

    metadata['size_x'] = 4
    metadata['size_y'] = 4
    metadata['size_z'] = 4

    metadata['extent_x'] = e_x
    metadata['extent_y'] = e_y

    floors_functions = [] 
    for i in range(metadata['generations']):
        floors_functions.append('house')

    metadata['function'] = floors_functions
    metadata['red_function'] = None
    metadata['green_function'] = None




elif node == 'PARKING':

    metadata['generations'] = n_generations

    metadata['size_x'] = 4
    metadata['size_y'] = 4
    metadata['size_z'] = 4

    metadata['extent_x'] = e_x
    metadata['extent_y'] = e_y

    floors_functions = [] 
    for i in range(metadata['generations']):
        if i%2 != 0:
            floors_functions.append('generic')
        else:
            floors_functions.append('office')

    metadata['function'] = floors_functions
    metadata['red_function'] = None
    metadata['green_function'] = None


elif node == 'STREET':

    metadata['generations'] = n_generations

    metadata['size_x'] = s_x
    metadata['size_y'] = s_y
    metadata['size_z'] = s_z

    metadata['extent_x'] = e_x
    metadata['extent_y'] = e_y

    floors_functions = [] 
    for i in range(metadata['generations']):
        floors_functions.append('generic')

    metadata['function'] = floors_functions
    metadata['red_function'] = None
    metadata['green_function'] = None


elif node == 'HIGHWAY':

    metadata['generations'] = n_generations

    metadata['size_x'] = s_x
    metadata['size_y'] = s_y
    metadata['size_z'] = s_z

    metadata['extent_x'] = e_x
    metadata['extent_y'] = e_y

    floors_functions = [] 
    for i in range(metadata['generations']):
        floors_functions.append('generic')

    metadata['function'] = floors_functions
    metadata['red_function'] = None
    metadata['green_function'] = None



elif node == 'INTERSECTION':

    metadata['generations'] = 3

    metadata['size_x'] = s_x
    metadata['size_y'] = s_y
    metadata['size_z'] = s_z

    metadata['extent_x'] = 15
    metadata['extent_y'] = 15

    floors_functions = [] 
    for i in range(metadata['generations']):
        floors_functions.append('generic')

    metadata['function'] = floors_functions
    metadata['red_function'] = None
    metadata['green_function'] = None



elif node == 'PARK' or node == 'GARDEN':

    metadata['generations'] = n_generations

    metadata['size_x'] = 6
    metadata['size_y'] = 6
    metadata['size_z'] = 6

    metadata['extent_x'] = e_x
    metadata['extent_y'] = e_y

    floors_functions = [] 
    for i in range(metadata['generations']):
        floors_functions.append('park')

    metadata['function'] = floors_functions
    metadata['red_function'] = None
    metadata['green_function'] = None




elif node == 'PARK':

    metadata['generations'] = n_generations

    metadata['size_x'] = 4
    metadata['size_y'] = 4
    metadata['size_z'] = 4

    metadata['extent_x'] = e_x
    metadata['extent_y'] = e_y

    floors_functions = [] 
    for i in range(metadata['generations']):
        floors_functions.append('park')

    metadata['function'] = floors_functions
    metadata['red_function'] = None
    metadata['green_function'] = None



elif node == 'MALL':

    metadata['generations'] = n_generations

    metadata['size_x'] = s_x
    metadata['size_y'] = s_y
    metadata['size_z'] = s_z

    metadata['extent_x'] = e_x
    metadata['extent_y'] = e_y

    floors_functions = [] 
    for i in range(metadata['generations']):
        floors_functions.append('mall')

    metadata['function'] = floors_functions
    metadata['red_function'] = None
    metadata['green_function'] = None



elif node == 'TEMPLE':

    metadata['generations'] = n_generations

    metadata['size_x'] = s_x
    metadata['size_y'] = s_y
    metadata['size_z'] = s_z

    metadata['extent_x'] = e_x
    metadata['extent_y'] = e_y

    floors_functions = [] 
    for i in range(metadata['generations']):
        floors_functions.append('gallery')

    metadata['function'] = floors_functions
    metadata['red_function'] = 'office'
    metadata['green_function'] = None




elif node == 'DOWNTOWN':

    metadata['generations'] = n_generations

    metadata['size_x'] = 2
    metadata['size_y'] = 2
    metadata['size_z'] = 4

    metadata['extent_x'] = e_x
    metadata['extent_y'] = e_y


    floors_functions = [] 
    for i in range(metadata['generations']):
        floors_functions.append('office')

    metadata['function'] = floors_functions
    metadata['red_function'] = None
    metadata['green_function'] = None




elif node == 'WAREHOUSE':

    metadata['generations'] = n_generations

    metadata['size_x'] = 4
    metadata['size_y'] = 4
    metadata['size_z'] = 4

    metadata['extent_x'] = e_x
    metadata['extent_y'] = e_y

    floors_functions = [] 
    for i in range(metadata['generations']):
        floors_functions.append('warehouse')

    metadata['function'] = floors_functions
    metadata['red_function'] = None
    metadata['green_function'] = None


elif node == 'MARKET':

    metadata['generations'] = n_generations

    metadata['size_x'] = 2
    metadata['size_y'] = 2
    metadata['size_z'] = 4

    metadata['extent_x'] = 24
    metadata['extent_y'] = 15

    floors_functions = [] 
    for i in range(metadata['generations']):
        floors_functions.append('generic')

    metadata['function'] = floors_functions
    metadata['red_function'] = 'park'
    metadata['green_function'] = None



elif node == 'POLICE':

    metadata['generations'] = n_generations

    metadata['size_x'] = s_x
    metadata['size_y'] = s_y
    metadata['size_z'] = s_z

    metadata['extent_x'] = e_x
    metadata['extent_y'] = e_y

    floors_functions = [] 
    for i in range(metadata['generations']):
        if i > 10:
            floors_functions.append('office')
        else:
            floors_functions.append('police')
        

    metadata['function'] = floors_functions
    metadata['red_function'] = None
    metadata['green_function'] = None


elif node == 'STORE':

    metadata['generations'] = 4

    metadata['size_x'] = 3
    metadata['size_y'] = 2
    metadata['size_z'] = 2

    metadata['extent_x'] = 30
    metadata['extent_y'] = 6

    floors_functions = [] 
    for i in range(metadata['generations']):
        if i > 2:
            floors_functions.append('generic')
        else:
            floors_functions.append('office')
        

    metadata['function'] = floors_functions
    metadata['red_function'] = None
    metadata['green_function'] = None



elif node == 'LAUNDROMAT':

    metadata['generations'] = n_generations

    metadata['size_x'] = 3
    metadata['size_y'] = 3
    metadata['size_z'] = 3

    metadata['extent_x'] = 10
    metadata['extent_y'] = 10

    floors_functions = [] 
    for i in range(metadata['generations']):
        if i % 2 == 0:
            floors_functions.append('office')
        else:
            floors_functions.append('gallery')
        

    metadata['function'] = floors_functions
    metadata['red_function'] = None
    metadata['green_function'] = None


elif node == 'POST':

    metadata['generations'] = 4

    metadata['size_x'] = 3
    metadata['size_y'] = 3
    metadata['size_z'] = 3

    metadata['extent_x'] = 6
    metadata['extent_y'] = 6

    floors_functions = [] 
    for i in range(metadata['generations']):
        if i > 2:
            floors_functions.append('generic')
        else:
            floors_functions.append('office')
        

    metadata['function'] = floors_functions
    metadata['red_function'] = None
    metadata['green_function'] = None


elif node == 'SKYSCRAPER':

    metadata['generations'] = n_generations

    metadata['size_x'] = 5
    metadata['size_y'] = 5
    metadata['size_z'] = 5

    metadata['extent_x'] = 15
    metadata['extent_y'] = 15

    floors_functions = [] 
    for i in range(metadata['generations']):
        floors_functions.append('skyscraper')

    metadata['function'] = floors_functions
    metadata['red_function'] = None
    metadata['green_function'] = None


elif node == 'TOWER':

    metadata['generations'] = n_generations

    metadata['size_x'] = 3
    metadata['size_y'] = 3
    metadata['size_z'] = 3

    metadata['extent_x'] = 10
    metadata['extent_y'] = 10

    floors_functions = [] 
    for i in range(metadata['generations']):
        floors_functions.append('skyscraper')

    metadata['function'] = floors_functions
    metadata['red_function'] = None
    metadata['green_function'] = None





elif node == 'SUPERMARKET':

    metadata['generations'] = n_generations

    metadata['size_x'] = 3
    metadata['size_y'] = 3
    metadata['size_z'] = 3

    metadata['extent_x'] = 9
    metadata['extent_y'] = 9

    floors_functions = [] 
    for i in range(metadata['generations']):
        if i > n_generations/2:
            floors_functions.append('generic')
        else:
            floors_functions.append('office')

    metadata['function'] = floors_functions
    metadata['red_function'] = None
    metadata['green_function'] = None


elif node == 'HOTEL':

    metadata['generations'] = n_generations

    metadata['size_x'] = 3
    metadata['size_y'] = 3
    metadata['size_z'] = 3

    metadata['extent_x'] = 11
    metadata['extent_y'] = 11

    floors_functions = [] 
    for i in range(metadata['generations']):
        
        if i%3 == 0:
            floors_functions.append('generic')
        if i%3 == 1:
            floors_functions.append('apartment')
        else:
            floors_functions.append('office')

    metadata['function'] = floors_functions
    metadata['red_function'] = None
    metadata['green_function'] = None




elif node == 'CASINO':

    metadata['generations'] = n_generations

    metadata['size_x'] = 3
    metadata['size_y'] = 3
    metadata['size_z'] = 3

    metadata['extent_x'] = 15
    metadata['extent_y'] = 15

    floors_functions = [] 
    for i in range(metadata['generations']):
        rn = random.random()
        if rn < 0.33:
            floors_functions.append('roof')
        elif rn > 0.66:
            floors_functions.append('police')
        else:
            floors_functions.append('factory_2')

    metadata['function'] = floors_functions
    metadata['red_function'] = None
    metadata['green_function'] = None



elif node == 'LIBRARY':

    metadata['generations'] = n_generations

    metadata['size_x'] = 4
    metadata['size_y'] = 4
    metadata['size_z'] = 4

    metadata['extent_x'] = 11
    metadata['extent_y'] = 11

    floors_functions = [] 
    for i in range(metadata['generations']):
        floors_functions.append('skyscraper')

    metadata['function'] = floors_functions
    metadata['red_function'] = None
    metadata['green_function'] = None



elif node == 'FACTORY':

    metadata['generations'] = 20

    metadata['size_x'] = 3
    metadata['size_y'] = 3
    metadata['size_z'] = 3

    metadata['extent_x'] = 10
    metadata['extent_y'] = 10

    floors_functions = [] 
    for i in range(metadata['generations']):
        if i <= 5:
            floors_functions.append('factory_1')
        else:
            floors_functions.append('factory_2')
            

    metadata['function'] = floors_functions
    metadata['red_function'] = None
    metadata['green_function'] = None


elif node == 'RIVER':

    metadata['generations'] = n_generations

    metadata['size_x'] = 1
    metadata['size_y'] = 1
    metadata['size_z'] = 1

    metadata['extent_x'] = 10
    metadata['extent_y'] = 10

    floors_functions = [] 
    for i in range(metadata['generations']):
        if i <= 5:
            floors_functions.append('factory_1')
        else:
            floors_functions.append('factory_2')
            

    metadata['function'] = floors_functions
    metadata['red_function'] = None
    metadata['green_function'] = None


elif node == 'SEA':

    metadata['generations'] = n_generations

    metadata['size_x'] = 1
    metadata['size_y'] = 1
    metadata['size_z'] = 1

    metadata['extent_x'] = 25
    metadata['extent_y'] = 10

    floors_functions = [] 
    for i in range(metadata['generations']):
            floors_functions.append('factory_2')

    metadata['function'] = floors_functions
    metadata['red_function'] = None
    metadata['green_function'] = None


elif node == 'BEACH':

    metadata['generations'] = n_generations

    metadata['size_x'] = 1
    metadata['size_y'] = 1
    metadata['size_z'] = 1

    metadata['extent_x'] = e_x
    metadata['extent_y'] = e_y

    floors_functions = [] 
    for i in range(metadata['generations']):
            floors_functions.append('generic')

    metadata['function'] = floors_functions
    metadata['red_function'] = None
    metadata['green_function'] = None


elif node == 'AIRPORT':

    metadata['generations'] = 20

    metadata['size_x'] = 3
    metadata['size_y'] = 3
    metadata['size_z'] = 3

    metadata['extent_x'] = 20
    metadata['extent_y'] = 20

    floors_functions = [] 
    for i in range(metadata['generations']):
        if i >= metadata['generations']-4:
            floors_functions.append('office')
        else:
            floors_functions.append('generic')

    metadata['function'] = floors_functions
    metadata['red_function'] = None
    metadata['green_function'] = None


elif node == 'PORT':

    metadata['generations'] = 15

    metadata['size_x'] = 3
    metadata['size_y'] = 3
    metadata['size_z'] = 3

    metadata['extent_x'] = 13
    metadata['extent_y'] = 20

    floors_functions = [] 
    for i in range(metadata['generations']):
        if i >= metadata['generations']-4:
            floors_functions.append('office')
        else:
            floors_functions.append('generic')

    metadata['function'] = floors_functions
    metadata['red_function'] = None
    metadata['green_function'] = None



elif node == 'CHURCH':

    metadata['generations'] = n_generations

    metadata['size_x'] = 3
    metadata['size_y'] = 3
    metadata['size_z'] = 3

    metadata['extent_x'] = 7
    metadata['extent_y'] = 10

    floors_functions = [] 
    for i in range(metadata['generations']):
            floors_functions.append('gallery')

    metadata['function'] = floors_functions
    metadata['red_function'] = None
    metadata['green_function'] = None






else: 
    metadata['generations'] = n_generations

    metadata['size_x'] = s_x
    metadata['size_y'] = s_y
    metadata['size_z'] = s_z

    metadata['extent_x'] = e_x
    metadata['extent_y'] = e_y

    floors_functions = [] 
    for i in range(metadata['generations']):
        floors_functions.append('generic')

    metadata['function'] = floors_functions
    metadata['red_function'] = None
    metadata['green_function'] = None

    print (f'{node} not found')










class Meta:
    def __init__(self, metadata):
        self.data = metadata

    def get(self, key):
        return (self.data[key])




extent_x = metadata.get('extent_x') or 10
extent_y = metadata.get('extent_y') or 10


sketch, metadata, red_picture, green_picture = draw_sketch(1000, extent_x, extent_y, node, metadata)

metadata = Meta(metadata)
picture = sketch
# ---------- end py3_4 ----------
panel_14 = Panel(py3_4.out)
panels_2 = Data(create_reference_10)
# PERMUTATIONS
toggle = BooleanToggle(False)
# Generate Pannustheka
generate_pannustheka = Python3Script(reference=panels_2, generate=toggle)  # -> pannustheka
# ---------- generate_pannustheka: Python ----------
import System
import Rhino
import Grasshopper

import rhinoscriptsyntax as rs
import ghpythonlib.treehelpers as th
import math
from compas.geometry import Transformation, Rotation, Translation, Reflection
from compas.geometry import Vector, Point


class MyComponent(Grasshopper.Kernel.GH_ScriptInstance):
    def RunScript(self, reference, generate):

        if reference == None:
            ghenv.Component.Message = "Please provide reference"
            return
            return
        elif not generate:
            ghenv.Component.Message = "All set up: \n Let's generate all the permutations!"
            return

        if generate: 

            # The process begins, the lines are drawn,  
            # A framework of motion, from dusk to dawn. 
            x_axis = Vector(1, 0, 0)                    
            y_axis = Vector(0, 1, 0)                    
            z_axis = Vector(0, 0, 1)                    

            # The heart of the fabric, the center’s grace,  
            # Around it we twist, reshape its space.  
            centroid = reference.get_centroid()

            # Spins of the loom, rotations defined,  
            # Axis by axis, the threads realigned.
            rotations_z = Matrices.get_roatation_matrix(z_axis, centroid)
            rotations_x = Matrices.get_roatation_matrix(x_axis, centroid)
            rotations_y = Matrices.get_roatation_matrix(y_axis, centroid)

            # Mirrors are placed, reflections we see.
            reflections = Matrices.get_reflection_matrix(centroid)

            # The library is woven, its fabric complete,  
            # Each piece unique, no pattern repeats.
            pannustheka = Pannustheka(reference, rotations_x, rotations_y, rotations_z, reflections)

            # A final check, to sift and refine,  
            # Only the unique, in this laundry line.  
            pannustheka.delete_same_permutations()

        ghenv.Component.Message = "Permutations generated"
        return pannustheka




"""
____    ____        _        _________   _______      _____   ____  ____  
|_   \  /   _|      / \      |  _   _  | |_   __ \    |_   _| |_  _||_  _| 
|   \/   |       / _ \     |_/ | | \_|   | |__) |     | |     \ \  / /   
| |\  /| |      / ___ \        | |       |  __ /      | |      > `' <    
_| |_\/_| |_   _/ /   \ \_     _| |_     _| |  \ \_   _| |_   _/ /'`\ \_  
|_____||_____| |____| |____|   |_____|   |____| |___| |_____| |____||____| 
"""


class Matrices(object):

    """
    In the world of the Matrix, where reality is fake,  
    Transformation is key, as the codes shift and break.  
    Each matrix a doorway, each method a key,  
    Unlocking the truth, setting minds free.  
    """

    def get_roatation_matrix(axis, rotation_point):
        """
        A twist in the code, reality bends,  
        Around an axis, the world never ends.  
        Rotating through space, in a digital trance,  
        With each turn, we break the illusion’s dance.  
        """
        
        # The identity matrix, the ground where we stand,
        # The world unchanging, as if by some hand.
        t0 = Matrices.get_identity_matrix()
        # A 90-degree turn, reality tilts and sways,
        # A quarter-turn twist, shifting the maze.
        r1 = Rotation.from_axis_and_angle(axis, math.pi/2, rotation_point)
        # A 180-degree turn, bending the world in two,
        # The shape shifts further, revealing what's new.
        r2 = Rotation.from_axis_and_angle(axis, math.pi, rotation_point)
        # A 270-degree twist, the illusion unravels more,
        # The boundaries of space become something we explore.
        r3 = Rotation.from_axis_and_angle(axis, (math.pi/2)*3, rotation_point)
        # A collection of turns, four steps in this dance,
        # A symphony of rotation, no matter the chance.
        rotation_list = [t0, r1, r2, r3]
        # Returning the rotations, a journey through space,
        # A broken illusion, a new reality to embrace.
        return rotation_list




    def get_reflection_matrix(centroid_point):
        """
        The mirror of truth, where worlds reflect,  
        In the Matrix’s glass, what’s real we detect.  
        Flip the plane, as the code rewrites,  
        Reflections of freedom in digital lights.  
        """

        # The identity matrix, still as the world stands,
        # A place where nothing changes, as reality expands.
        t0 = Matrices.get_identity_matrix()
        # Reflection on the x-plane, the world turns, flipped,
        # A mirrored view, where the truth is equipped.
        mrx = Reflection.from_plane(([centroid_point[0], centroid_point[1], centroid_point[2]], [1,0,0]))
        # Reflection on the y-plane, bending the code,
        # A shift of perception, where light starts to explode.
        mry = Reflection.from_plane(([centroid_point[0], centroid_point[1], centroid_point[2]], [0,1,0]))
        # Reflection on the z-plane, where depth comes alive,
        # Flipping through dimensions, the Matrix starts to drive.
        mrz = Reflection.from_plane(([centroid_point[0], centroid_point[1], centroid_point[2]], [0,0,1]))
        # A collection of reflections, shifting the shape of space,
        # A new way of seeing, where truth finds its place.
        reflections_list = [t0, mrx, mry, mrz]
        # Returning the reflections, a world turned around,
        # In the mirror of the Matrix, where freedom is found.
        return reflections_list




    def get_identity_matrix(): 
        """
        The Matrix’s base, where all things begin,  
        A world unchanging, where nothing within.  
        It’s the root of all, the place we must start,  
        The code behind the code, the hidden heart.  
        """ 

        # The identity matrix, where nothing changes,  
        # A world in stasis, where time rearranges.
        identity_matrix =   [[1.0000, 0.0000, 0.0000, 0.0000], 
                            [0.0000, 1.0000, 0.0000, 0.0000], 
                            [0.0000, 0.0000, 1.0000, 0.0000], 
                            [0.0000, 0.0000, 0.0000, 1.0000]]
        # Returning the identity, the essence of the start,  
        # The silent code that holds the Matrix apart.
        return identity_matrix

"""
██████╗  █████╗ ███╗   ██╗███╗   ██╗██╗   ██╗███████╗
██╔══██╗██╔══██╗████╗  ██║████╗  ██║██║   ██║██╔════╝
██████╔╝███████║██╔██╗ ██║██╔██╗ ██║██║   ██║███████╗
██╔═══╝ ██╔══██║██║╚██╗██║██║╚██╗██║██║   ██║╚════██║
██║     ██║  ██║██║ ╚████║██║ ╚████║╚██████╔╝███████║
╚═╝     ╚═╝  ╚═╝╚═╝  ╚═══╝╚═╝  ╚═══╝ ╚═════╝ ╚══════╝
"""

class Pannus(object):
    """
    A garment in the code, woven from points and threads,  
    Each point a stitch, each change a shift.  
    Like clothes hung out, blowing in the breeze,  
    The fabric shifts and flows with each gentle spin.
    """

    def __init__(self, reference, rotation_x, rotation_y, rotation_z, reflection, transformed_points):
        """
        The washing begins—spinning, turning, and pressing,  
        The cloth gets cleaned, its shape confessing.  
        Points are turned, stretched, and renewed,  
        A new fabric appears, in a fresh point of view.
        """
        # The threads of the fabric, reshaped and defined,
        # Each transformed point forms a new design.
        self.points = transformed_points
        self.points_count = len(self.points)
        # The cloth before the wash, unaltered and plain,
        # The original form, before shifts begin their reign.
        self.original_mesh = reference.mesh
        self.rotation_z = rotation_z
        self.rotation_x = rotation_x
        self.rotation_y = rotation_y
        self.reflection = reflection
        
        # A fabric transformed, each fold and crease,
        # Spun through reflections and rotations, to find release.
        mesh = self.original_mesh.copy()
        mesh.transform(reflection)
        mesh.transform(rotation_z)
        mesh.transform(rotation_x)
        mesh.transform(rotation_y)
        self.mesh = mesh
        
        # Stitches of memory, marking where points align,
        # A rule emerges from the cloth’s woven design.
        rule_string = []
        
        # The garment’s frame, its corners precise,
        # A box that contains its vertices, so nice.
        self.box = reference.box
        self.vertices = reference.box.points

        # Generating the fabric's unique passport,
        # Where points meet the frame, their positions report.   
        for vertex in self.vertices:
            i = 0
            gate = True
            for point in self.points:
                # Checking if a thread aligns with the frame,
                # Marking its position in this geometric game.
                if round(point.x, 3) == round(vertex.x, 3) and round(point.y, 3) == round(vertex.y, 3) and round(point.z, 3) == round(vertex.z, 3):
                    rule_string.append(1)
                    gate = False
                # If no alignment, a gap appears,
                # A void in the weave, like forgotten years.    
                if i == self.points_count -1 and gate:
                    rule_string.append(0)
                i += 1
        # The unique pattern of the cloth is set,
        # Its rule defined, like a tailored silhouette.
        self.rule = rule_string
        self.function = reference.function




    def generate_all_pemutations(reference, rotations_x, rotations_y, rotations_z, reflections):
        """
        The cloth, stretched wide, hung on many lines,  
        Each fold, each twist, in the wind it climbs.  
        The fabric reshapes, new patterns are born,  
        Spinning in the breeze, like clothes on a morn.
        """
        # A collection of garments, each with a new face,
        # Twisting and turning, reshaped in their place
        pannustheka = []
        # Through reflections, the mirror bends the cloth,
        # Folding its shape, like a washer's froth.
        for mr in reflections:                    
            for rz in rotations_z:
                for rx in rotations_x:
                    for ry in rotations_y:
                        # The cloth spins, its threads take new forms,
                        # Rotated and mirrored, reshaping the norms.
                        transformed_points = Pannus.transform_points(reference.points, mr, rx, ry, rz)
                        pannus = Pannus(reference, rx, ry, rz, mr, transformed_points)
                        pannustheka.append(pannus)
        # Each garment reborn, a new design revealed,
        # Hung in the pannustheka, its fate is sealed.          
        return pannustheka




    def transform_points(points, reflection, rotation_x, rotation_y, rotation_z):
        """
        Each point a thread, spun and twisted around,  
        The fabric reshaped, turning, spinning, unbound.  
        Like clothes swaying, each point takes flight,  
        In a fresh new direction, changing its sight.
        """
        # A new thread begins, a journey to weave,  
        # Each point reshaped, its form to perceive.
        point_group = []
        for point in points:
            # The thread is copied, its essence retained,  
            # Ready for transformation, its shape unchained
            pt = point.copy()
            # A reflection in glass, a reversal so clear,  
            # Flipping the thread to a view more near.
            pt.transform(reflection)
            # Twisting through angles, like cloth in the breeze,  
            # Each rotation a fold, a moment to seize.
            pt.transform(rotation_z)
            pt.transform(rotation_x)
            pt.transform(rotation_y)
            # The thread joins the group, a stitch in the seam,  
            # Completing the pattern, like cloth in a dream.
            point_group.append(pt)
        # The fabric returns, reshaped and refined,  
        # A collection of points, with purpose aligned.
        return point_group


    def get_file_name(self):
        """
        A label stitched into the cloth, its name so true,  
        A pattern formed from the rules, a design to view.  
        The file is the garment, marked for all to see,  
        With a name that tells the story of its fabric’s decree.
        """
        file_name = self.function + "_" + str(self.rule) + ".3dm"
        return file_name

"""
██████╗  █████╗ ███╗   ██╗███╗   ██╗██╗   ██╗███████╗████████╗██╗  ██╗███████╗██╗  ██╗ █████╗ 
██╔══██╗██╔══██╗████╗  ██║████╗  ██║██║   ██║██╔════╝╚══██╔══╝██║  ██║██╔════╝██║ ██╝ ██╔══██╗
██████╔╝███████║██╔██╗ ██║██╔██╗ ██║██║   ██║███████╗   ██║   ███████║█████╗  █████║  ███████║
██╔═══╝ ██╔══██║██║╚██╗██║██║╚██╗██║██║   ██║╚════██║   ██║   ██╔══██║██╔══╝  ██╔═██╗ ██╔══██║
██║     ██║  ██║██║ ╚████║██║ ╚████║╚██████╔╝███████║   ██║   ██║  ██║███████╗██║  ██║██║  ██║
╚═╝     ╚═╝  ╚═╝╚═╝  ╚═══╝╚═╝  ╚═══╝ ╚═════╝ ╚══════╝   ╚═╝   ╚═╝  ╚═╝╚══════╝╚═╝  ╚═╝╚═╝  ╚═╝

"""

class Pannustheka(object):
    """
    A library of wonders, where fabrics combine,  
    Permutations of cloth, in threads they align.  
    Each twist, each turn, a new piece unfolds,  
    The library overflows with stories untold.
    """
    def __init__(self, reference, rotations_x, rotations_y, rotations_z, reflections):
        """
        The basket is empty, awaiting its fill,  
        Garments of wonder, shaped by the will.  
        Each fold and twist, a dance of delight,  
        As the cloth transforms in the morning light.
        """
        # The permutations begin, each one unique,  
        # Threads interwoven, a form to seek.
        self.permutations = []

        for mr in reflections:                    
            for rz in rotations_z:
                for rx in rotations_x:
                    for ry in rotations_y:

                        # The fabric is spun through mirrors and turns,  
                        # Each pannus a story, a craft to discern.
                        transformed_points = Pannus.transform_points(reference.points, mr, rx, ry, rz)
                        pannus = Pannus(reference, rx, ry, rz, mr, transformed_points)

                        # The library receives this freshly woven piece,  
                        # A permutation created, its work to release.
                        self.permutations.append(pannus)




    def delete_same_permutations(self):
        """
        The basket is full, yet order must reign,  
        Sorting through garments, we strive to sustain.  
        Each fold inspected, each thread aligned,  
        Removing duplicates, a clearer desig
        """
        # A new collection begins, fresh and refined,  
        # Only unique patterns, a treasure to find.
        reduced_pannustheka = []
        identity_list = []
        
        for pannus in self.permutations:
            # If this garment’s pattern is one of a kind,  
            # Into the collection, it’s lovingly assigned
            if pannus.rule not in identity_list:
                reduced_pannustheka.append(pannus)
                identity_list.append(pannus.rule)  

        # The library now holds a more perfect selection,  
        # A wardrobe of harmony, free from imperfection.
        self.permutations = reduced_pannustheka
# ---------- end generate_pannustheka ----------
visualize_sketch = Python3Script(picture_b=py3_4.picture, picture_g=py3_4.green_picture, picture_r=py3_4.red_picture, show=Button())
# ---------- visualize_sketch: Python ----------
from compas_rhino.devtools import DevTools
DevTools.ensure_path()


from HAL.pixels import screen_blend

if show:
    sketch = screen_blend(picture_b, picture_g)
    sketch = screen_blend(sketch, picture_r)
    sketch.show()
# ---------- end visualize_sketch ----------
visualize_sketch_2 = Python3Script(picture=py3_4.picture, show=Button())
# ---------- visualize_sketch_2: Python ----------
from compas_rhino.devtools import DevTools
DevTools.ensure_path()

if show:
    picture.show()
# ---------- end visualize_sketch_2 ----------
# Visualize Pannustheka
visualize_pannustheka = Python3Script(pannustheka=generate_pannustheka)  # -> pannus, bbox, points
# ---------- visualize_pannustheka: Python ----------
import System
import Rhino
import Grasshopper

import rhinoscriptsyntax as rs
import System
import Rhino
import Grasshopper

import rhinoscriptsyntax as rs
import rhinoscriptsyntax as rs
from compas_rhino.conversions import point_to_compas, line_to_rhino, point_to_rhino, mesh_to_rhino, box_to_rhino
from ghpythonlib.componentbase import executingcomponent as component
import ghpythonlib.treehelpers as th
from compas.scene import SceneObject
from compas.geometry import Vector, Point, Translation




class MyComponent(Grasshopper.Kernel.GH_ScriptInstance):
    
    def RunScript(self, pannustheka):

        if pannustheka == None:
            ghenv.Component.Message = "Please provide pannustheka"
            return


        # The origin, the beginning, the place where it starts, 
        origin = pannustheka.permutations[0].box.frame.point.copy()
        # A point copied from the first, a seed in the soil,  
        # From this, all things will grow, and with it, toil.
        
        
        # Now gather the empty canvas, waiting to be filled,  
        pannus = []
        bbox = []
        points = []
        # Empty vessels, like a poet’s blank page,  
        # Await the coming of shapes to step from the stage.
        
        
        # A dance begins, as permutations swirl,
        for permutation in pannustheka.permutations:
        
            # The mesh, an ethereal shape, now takes form,  
            # In this space, it shall bend and transform.
            mesh = permutation.mesh.copy()
            # The box, a boundary that keeps it all tight,  
            # Holding the chaos, defining the light
            box = permutation.box.copy()
            # Points, like whispers, scattered and free,  
            # Each a part of a greater symmetry.
            c_points = permutation.points.copy()
            
            
        
            # Translation—a shift, a gentle move,  
            # The box’s frame, now set to prove.
            translation_vector = Vector.from_start_end(box.frame.point, origin)
        
            # A matrix born from the vector’s breath,  
            # Shaping form, conquering death.
            translation_matrix = Translation.from_vector(translation_vector)
            
        
            # Mesh transforms, with elegance it moves,  
            # Changing place, its shape improves.
            mesh.transform(translation_matrix)
            pannus.append(mesh_to_rhino(mesh))
            # Brought to life in Rhino's embrace,  
            # The mesh now finds its rightful place.
        
            
            # The bounding box follows close behind,  
            # Transformed, it aligns, in the same frame, confined.
            box.transform(translation_matrix)
            bbox.append(box_to_rhino(box))
            # The edges are sharp, the corners are clear,  
            # In the same world, they now appear.
                
            
            # Points are not forgotten, each one moves,  
            # A soft step forward, as each one improves.
            for pt in c_points:
                pt.transform(translation_matrix)
                points.append(point_to_rhino(pt))
                # A journey they take, across the sky,  
                # Each point ascends, too proud to deny.
                
            
            # The origin climbs, a gentle rise,  
            # Reaching upwards, toward endless skies.
            origin.z = origin.z + 2
            # Upward it soars, in its quiet refrain,  
            # The z-axis bending, again and again.
        
        
        pannus = th.list_to_tree(pannus)
        bbox = th.list_to_tree(bbox)
        points = th.list_to_tree(points)

        ghenv.Component.Message = ""

        return pannus, bbox, points
# ---------- end visualize_pannustheka ----------
path_2 = FilePath("C:\Users\computer-1\ERIC_DOCUMENTS\PANNUSTHEKA\")
pannustheka = FilePath(path_2)
panel_15 = Panel("factory_1")
wires = BrepWireframe(Brep=visualize_pannustheka.bbox, Density=-1)
# Export Pannustheka
boolean_toggle = BooleanToggle(False)

number_slider = Slider(100, range=0..100)
py3_5 = Python3Script(metadata=py3_4.metadata)  # -> x_sketch, y_sketch
# ---------- py3_5: Python ----------
x_sketch = metadata.get('extent_x') * metadata.get('size_x')
y_sketch = metadata.get('extent_y') * metadata.get('size_y')
# ---------- end py3_5 ----------
py3_6 = Python3Script(sketch=py3_4.picture, size_x=py3_5.x_sketch, size_y=py3_5.y_sketch, sample_on_x=number_slider, sample_on_y=number_slider)  # -> out, mesh, pixels_color; inputs sample_on_x: Int32, sample_on_y: Int32
# ---------- py3_6: Python ----------
import System
import Rhino
import Grasshopper

import rhinoscriptsyntax as rs
import ghpythonlib.treehelpers as th

import ghpythonlib.components as ghcomp

from Rhino.Geometry import Plane

from System.Drawing import Color

from PIL import Image


class MyComponent(Grasshopper.Kernel.GH_ScriptInstance):
    def RunScript(self, sketch, size_x, size_y, sample_on_x: int, sample_on_y: int):
  
        image = sketch.image


        pixels_color = sample_image(image, sample_on_x, sample_on_y)

        mesh = create_mesh(size_x, size_y, sample_on_x, sample_on_y)

        mesh = color_mesh(mesh, pixels_color)

        pixels_color = th.list_to_tree(pixels_color)



        return mesh, pixels_color




def import_image(image_path):
    images = []
    for img in image_path:
        image = Image.open(img)
        images.append(image)
    return images

def get_width(image):
    width = image.size[0]
    return width

def get_height(image):
    height = image.size[1]
    return height


def sample_image(image, sample_on_x, sample_on_y):


    width = get_width(image)
    height = get_height(image)

    pixels_image = []

    for x in range(sample_on_x):
        for y in range(sample_on_y):
            pixel_x = width/sample_on_x * x
            pixel_y = height/sample_on_y * y

            pixel = image.getpixel((pixel_x, height - 1 - pixel_y))
            color = Color.FromArgb(pixel[0], pixel[1], pixel[2])
            pixels_image.append(color)


    return pixels_image


def create_mesh(size_x, size_y, sample_on_x, sample_on_y):
    surface = ghcomp.PlaneSurface(Plane.WorldXY, size_x, size_y)
    mesh = ghcomp.MeshSurface(surface, sample_on_x-1, sample_on_y-1, True, False)

    return mesh
   

def color_mesh(mesh, colors):
    mesh = ghcomp.MeshColours(mesh, colors)
    return mesh
# ---------- end py3_6 ----------
chroma_culler = Python3Script(
    mesh=py3_6.mesh,
    colors=py3_6.pixels_color,
    color_to_analyze=ColourSwatch(SwatchColor=RGB(0, 0, 255)),
    threshold=Slider(43, range=0..100))  # -> mesh; inputs mesh: Mesh, colors: list of Color
# ---------- chroma_culler: Python ----------
import System
import Rhino
import Grasshopper

from Rhino.Geometry import Interval

import ghpythonlib.components as ghcomp

import rhinoscriptsyntax as rs

class MyComponent(Grasshopper.Kernel.GH_ScriptInstance):
    def RunScript(self,
            mesh: Rhino.Geometry.Mesh,
            colors: System.Collections.Generic.List[System.Drawing.Color],
            color_to_analyze,
            threshold):

        reds, greens, blues = split_colors(colors)

        domain_red, domain_green, domain_blue = get_color_domain(color_to_analyze, threshold)

        red_inclusions = get_inclusions(reds, domain_red)
        green_inclusions = get_inclusions(greens, domain_green)
        blue_inclusions = get_inclusions(blues, domain_blue)

        color_inclusions = and_gate(red_inclusions, green_inclusions, blue_inclusions)
        
        mesh = cull_mesh(mesh, color_inclusions)

        return mesh
            




def split_colors(colors):
    reds = []
    greens = []
    blues = []
    for color in colors:
        #print(dir(color))
        red = color.R
        reds.append(red)
        green = color.G
        greens.append(green)
        blue = color.B
        blues.append(blue)
    
    return reds, greens, blues


def get_color_domain(color, threshold):
    red = color.R
    green = color.G
    blue = color.B

    domain_red = Interval(red-threshold, red+threshold)
    domain_green = Interval(green-threshold, green+threshold)
    domain_blue = Interval(blue-threshold, blue+threshold)

    return domain_red, domain_green, domain_blue


def get_inclusions(values, interval):
    inclusions = []
    for value in values:
        inclusions.append(interval.IncludesParameter(value))
    return inclusions


def and_gate(red_inclusions, green_inclusions, blue_inclusions):
    color_inclusions = []
    for i in range(len(red_inclusions)):
        color_inclusions.append(red_inclusions[i] and green_inclusions[i] and blue_inclusions[i])
    return color_inclusions
    
        
def cull_mesh(mesh, color_inclusions):
    mesh = ghcomp.CullVertices(mesh, color_inclusions, False)
    return mesh
# ---------- end chroma_culler ----------

number_slider_2 = Slider(50, range=0..100)
py3_7 = Python3Script(metadata=py3_4.metadata)  # -> x_sketch, y_sketch; same code as py3_5
py3_8 = Python3Script(
    sketch=py3_4.green_picture,
    size_x=py3_7.x_sketch,
    size_y=py3_7.y_sketch,
    sample_on_x=number_slider_2,
    sample_on_y=number_slider_2)  # -> out, mesh, pixels_color; inputs sample_on_x: Int32, sample_on_y: Int32; same code as py3_6
# DECODING PICTURES
chroma_culler_2 = Python3Script(
    mesh=py3_8.mesh,
    colors=py3_8.pixels_color,
    color_to_analyze=ColourSwatch(SwatchColor=RGB(0, 255, 0)),
    threshold=Slider(43, range=0..100))  # -> mesh; inputs mesh: Mesh, colors: list of Color; same code as chroma_culler

number_slider_3 = Slider(50, range=0..100)
py3_9 = Python3Script(metadata=py3_4.metadata)  # -> x_sketch, y_sketch; same code as py3_5
py3_10 = Python3Script(
    sketch=py3_4.red_picture,
    size_x=py3_9.x_sketch,
    size_y=py3_9.y_sketch,
    sample_on_x=number_slider_3,
    sample_on_y=number_slider_3)  # -> out, mesh, pixels_color; inputs sample_on_x: Int32, sample_on_y: Int32
# ---------- py3_10: Python ----------
# venv: ca-fs25

import System
import Rhino
import Grasshopper

import rhinoscriptsyntax as rs
import ghpythonlib.treehelpers as th

import ghpythonlib.components as ghcomp

from Rhino.Geometry import Plane

from System.Drawing import Color

from PIL import Image


class MyComponent(Grasshopper.Kernel.GH_ScriptInstance):
    def RunScript(self, sketch, size_x, size_y, sample_on_x: int, sample_on_y: int):
  
        image = sketch.image


        pixels_color = sample_image(image, sample_on_x, sample_on_y)

        mesh = create_mesh(size_x, size_y, sample_on_x, sample_on_y)

        mesh = color_mesh(mesh, pixels_color)

        pixels_color = th.list_to_tree(pixels_color)



        return mesh, pixels_color




def import_image(image_path):
    images = []
    for img in image_path:
        image = Image.open(img)
        images.append(image)
    return images

def get_width(image):
    width = image.size[0]
    return width

def get_height(image):
    height = image.size[1]
    return height


def sample_image(image, sample_on_x, sample_on_y):


    width = get_width(image)
    height = get_height(image)

    pixels_image = []

    for x in range(sample_on_x):
        for y in range(sample_on_y):
            pixel_x = width/sample_on_x * x
            pixel_y = height/sample_on_y * y

            pixel = image.getpixel((pixel_x, height - 1 - pixel_y))
            color = Color.FromArgb(pixel[0], pixel[1], pixel[2])
            pixels_image.append(color)


    return pixels_image


def create_mesh(size_x, size_y, sample_on_x, sample_on_y):
    surface = ghcomp.PlaneSurface(Plane.WorldXY, size_x, size_y)
    mesh = ghcomp.MeshSurface(surface, sample_on_x-1, sample_on_y-1, True, False)

    return mesh
   

def color_mesh(mesh, colors):
    mesh = ghcomp.MeshColours(mesh, colors)
    return mesh
# ---------- end py3_10 ----------
chroma_culler_3 = Python3Script(
    mesh=py3_10.mesh,
    colors=py3_10.pixels_color,
    color_to_analyze=ColourSwatch(SwatchColor=RGB(255, 0, 0)),
    threshold=Slider(43, range=0..100))  # -> mesh; inputs mesh: Mesh, colors: list of Color; same code as chroma_culler

export_pannustheka = Python3Script(pannustheka=generate_pannustheka, file_path=pannustheka, export=boolean_toggle)
# ---------- export_pannustheka: Python ----------
import System
import Rhino
import Grasshopper

import rhinoscriptsyntax as rs
import rhinoscriptsyntax as rs
import Rhino.FileIO
import System
from compas_rhino.conversions import mesh_to_rhino, point_to_rhino, box_to_rhino




class MyComponent(Grasshopper.Kernel.GH_ScriptInstance):
    def RunScript(self, pannustheka, file_path, export):


        if pannustheka == None:
            ghenv.Component.Message = "Please provide pannustheka"
            return
        elif file_path == None:
            ghenv.Component.Message = "Please provide pannustheka file_path"
            return
        elif not export:
            ghenv.Component.Message = "All set up: let's export!" 
            return


        """
        ___  __  __  ___    ___    ___   _____   ___   _  _    ___                  
        | __| \ \/ / | _ \  / _ \  | _ \ |_   _| |_ _| | \| |  / __|                 
        | _|   >  <  |  _/ | (_) | |   /   | |    | |  | .` | | (_ |                 
        |___| /_/\_\ |_|    \___/  |_|_\   |_|   |___| |_|\_|  \___|                 
        ___     _     _  _   _  _   _   _   ___   _____   _  _   ___   _  __    _   
        | _ \   /_\   | \| | | \| | | | | | / __| |_   _| | || | | __| | |/ /   /_\  
        |  _/  / _ \  | .` | | .` | | |_| | \__ \   | |   | __ | | _|  | ' <   / _ \ 
        |_|   /_/ \_\ |_|\_| |_|\_|  \___/  |___/   |_|   |_||_| |___| |_|\_\ /_/ \_\
        
                AN EPIC POEM                                                                        
                                                        
        
                
            PROEM
        
                Lo! The mighty function arises, its task to craft
                A file of destiny, where data shall be drafted.
                It calls upon the mesh, the points, and the name,
                To export them to a realm where they are made to claim.
        """


        # The loop now begins, as permutations arise,
        # Each one a new path, each one a new prize.   
        if export:
            for permutation in pannustheka.permutations:
                
                # The path to the file, for each permutation made,
                # Defined by *get_file_name*, where it shall be laid.
                specific_file_path = file_path + permutation.get_file_name()

                # The mesh, transformed by magic unseen,
                # *mesh_to_rhino* makes it serene.
                specific_mesh = mesh_to_rhino(permutation.mesh)

                # The points, too, must be converted,
                # *point_to_rhino* takes them to where
                # to read and write, each a shining light.
                specific_points = []
                for pt in permutation.points: specific_points.append(point_to_rhino(pt))

                # The vertices, too, must follow this path,
                # Converted to Rhinos, to avoid their wrath.
                specific_vertices = []
                for pt in permutation.vertices: specific_vertices.append(point_to_rhino(pt))

                # At last, the export function calls with great might,
                # And the file is written, to the great delight.
                export_file(specific_mesh, specific_points, specific_vertices, specific_file_path)

        ghenv.Component.Message = "Exported"

        return

    
def export_file(mesh, points, vertices, file_path_function):
    # Behold, the file to export, a vessel anew,
    # *File3dm*, empty and waiting for you.
    file_to_export = Rhino.FileIO.File3dm()
    
    # The layers shall be forged with colors bold,
    # Each object to reside in a layer of gold.
    layer_table = file_to_export.AllLayers
    
    # Mesh in black, the first to arise,
    # Points in red, a fiery surprise,
    # Bounding box, as blue as the sky,
    # These colors shall guide, where the objects lie.
    layer_table.AddLayer("mesh", System.Drawing.Color.Black)
    layer_table.AddLayer("points", System.Drawing.Color.Red)
    layer_table.AddLayer("bounding_box_points", System.Drawing.Color.Blue)
    
    # Now, the objects, like stars, must be placed,
    # In the right layer, with care and with grace.
    object_table = file_to_export.Objects
    objects_attributes = Rhino.DocObjects.ObjectAttributes()
    
    # The mesh to layer 0, where it will rest,
    # In the "mesh" layer, it will be its best.
    objects_attributes.LayerIndex = 0
    object_table.AddMesh(mesh, objects_attributes) 

    # Points to layer 1, where they will be seen,
    # Each one of red, like a fiery dream
    objects_attributes.LayerIndex = 1
    if isinstance(points, list):

        # If points are many, iterate and add them,
        # One by one, they shall be given their form.   
        for p in points:
            object_table.AddPoint(p, objects_attributes)
    else:
        # If a single point stands in the light,
        # Add it directly, without fright.
        object_table.AddPoint(points, objects_attributes)


    # Vertices to layer, blue as the sea,
    # These points of bounding boxes will forever be free.
    objects_attributes.LayerIndex = 2
    # If vertices are many, iterate through the fray,
    # Add them to the file, without delay.
    if isinstance(vertices, list):
        for p in vertices:
            object_table.AddPoint(p, objects_attributes)
    else:
        # One vertex alone shall stand in the blue,
        # Add it with care, as the code must do.
        object_table.AddPoint(points, objects_attributes)
    
    # And now, the file is ready to be sealed,
    # The write options set, the path revealed.
    # Version 8 it shall bear, a future so bright,
    # Export it, and let it take flight. 
    
    write_options = Rhino.FileIO.File3dmWriteOptions()
    write_options.Version = 8
    file_to_export.Write(file_path_function, write_options)





""" 

    EPILOGUE
    
    
            Thus ends this saga, this code's noble flight,
            A tale of creation, in the soft moonlight.
            The file now complete, its mission divine,
            Till the next great export, when the stars align.


"""
# ---------- end export_pannustheka ----------
custom_preview = CustomPreview(Geometry=visualize_pannustheka.pannus, Material=ColourSwatch(SwatchColor=RGB(95, 131, 158)))
custom_preview_2 = CustomPreview(Geometry=wires, Material=ColourSwatch(SwatchColor=RGB(150, 150, 150)))
custom_preview_3 = CustomPreview(Geometry=visualize_pannustheka.points, Material=ColourSwatch(SwatchColor=RGB(189, 38, 38)))
py3_11 = Python3Script(metadata=py3_4.metadata)  # -> n_floors, blue_function
# ---------- py3_11: Python ----------
n_floors = metadata.get('generations')
blue_function = metadata.get('function')

print(n_floors, blue_function)
# ---------- end py3_11 ----------
panel_16 = Panel(py3_11.blue_function)
medges = MeshEdges(Mesh=chroma_culler_2)  # -> NakedEdges, InteriorEdges, NonManifoldEdges
medges_2 = MeshEdges(Mesh=chroma_culler_3)  # -> NakedEdges, InteriorEdges, NonManifoldEdges
medges_3 = MeshEdges(Mesh=chroma_culler)  # -> NakedEdges, InteriorEdges, NonManifoldEdges
default_floor_function = Python3Script(n_floors=py3_11.n_floors, function=panel_16, overdrive_generic=Toggle(False))  # -> floors_functions; inputs n_floors: Int32, function: String
# ---------- default_floor_function: Python ----------
"""Grasshopper Script Instance"""
import System
import Rhino
import Grasshopper

import ghpythonlib.treehelpers as th
import rhinoscriptsyntax as rs

class MyComponent(Grasshopper.Kernel.GH_ScriptInstance):
    def RunScript(self, n_floors: int, function: str, overdrive_generic):

        if n_floors == None:
            ghenv.Component.Message = "Please provide number of floors"
            return

        floors_functions = []

        if overdrive_generic: function = 'generic'
        
        for i in range(n_floors):
            floors_functions.append(function)

        #floors_functions = th.list_to_tree(floors_functions)

        ghenv.Component.Message = "List of default floors created"
        return floors_functions
# ---------- end default_floor_function ----------
join = JoinCurves(Curves=medges.NakedEdges, Preserve=False)
join_2 = JoinCurves(Curves=medges_2.NakedEdges, Preserve=False)
join_3 = JoinCurves(Curves=medges_3.NakedEdges, Preserve=False)
len = Length(Curve=join)
len_2 = Length(Curve=join_2)
len_3 = Length(Curve=join_3)
sort = SortList(Keys=len, ValuesA=join)  # -> Keys, ValuesA
sort_2 = SortList(Keys=len_2, ValuesA=join_2)  # -> Keys, ValuesA
sort_3 = SortList(Keys=len_3, ValuesA=join_3)  # -> Keys, ValuesA
# Create Floor
create_floor = Python3Script(floor_functions=py3_11.blue_function)  # -> floors; inputs floor_functions: list of String
#   port floor_functions: List of the floor functions. On top the ground floor.
#   port floors: List of Floors objects
# ---------- create_floor: Python ----------
"""Grasshopper Script Instance"""
import System
import Rhino
import Grasshopper

import rhinoscriptsyntax as rs
import ghpythonlib.treehelpers as th

class MyComponent(Grasshopper.Kernel.GH_ScriptInstance):
    def RunScript(self, floor_functions: System.Collections.Generic.List[str]):

        if floor_functions == None:
            ghenv.Component.Message = "Please provide list of floors functions"
            return

        floors = []
        #The pairing starts, the list unfolds,
        for i, function in enumerate(floor_functions):
            #A floor takes shape, its story told.
            #Its number set, its role defined,
            floor = Floor(i, function)
            #Each step reveals a thoughtful design.
            floors.append(floor)
            
        ghenv.Component.Message = f"Created {len(floors)} floors"

        #floors = th.list_to_tree(floors)
        return floors



"""
/$$$$$$$$ /$$        /$$$$$$   /$$$$$$  /$$$$$$$   /$$$$$$ 
| $$_____/| $$       /$$__  $$ /$$__  $$| $$__  $$ /$$__  $$
| $$      | $$      | $$  \ $$| $$  \ $$| $$  \ $$| $$  \__/
| $$$$$   | $$      | $$  | $$| $$  | $$| $$$$$$$/|  $$$$$$ 
| $$__/   | $$      | $$  | $$| $$  | $$| $$__  $$ \____  $$
| $$      | $$      | $$  | $$| $$  | $$| $$  \ $$ /$$  \ $$
| $$      | $$$$$$$$|  $$$$$$/|  $$$$$$/| $$  | $$|  $$$$$$/
|__/      |________/ \______/  \______/ |__/  |__/ \______/                                                            
"""
class Floor(object):

    """
    A Floor object, simple and neat,
    To help a blueprint be complete.
    Its number shows its ordered spot,
    Its function tells the role it's got.
    """

    def __init__(self, number, function):
        self.number = number
        self.function = function
# ---------- end create_floor ----------
cull_i = CullIndex(List=sort.ValuesA, Indices="-1", Wrap=True)
cull_i_2 = CullIndex(List=sort_2.ValuesA, Indices="-1", Wrap=True)
cull_i_3 = CullIndex(List=sort_3.ValuesA, Indices="-1", Wrap=True)
area = Area(Geometry=cull_i_3)  # -> Area, simplify(Centroid)
# Create Blueprint
create_blueprint = Python3Script(floors=create_floor)  # -> blueprint, ascii_section; inputs floors: list
# ---------- create_blueprint: Python ----------
# First, we reverse the order, a shift in the flow,  
# To change the perspective, let the levels grow.
import System
import Rhino
import Grasshopper

import rhinoscriptsyntax as rs

class MyComponent(Grasshopper.Kernel.GH_ScriptInstance):
    def RunScript(self, floors: System.Collections.Generic.List[object]):
            
        if floors == None:
            ghenv.Component.Message = "Please provide floors"
            return


        floors.reverse()

        # A **Blueprint** is formed, with floors now aligned,  
        # A vision in code, perfectly designed.  
        blueprint = Blueprint(floors)

        # Now the **ASCII blueprint** comes to life,  
        # Each floor’s tale, clear without strife.  
        ascii_section = blueprint.get_ASCII_blueprint()

        ghenv.Component.Message = "Have fun with the blueprint!"
        return blueprint, ascii_section




"""
____   .     .     . .____  .___  .___  _ __    _  _______
/   \  /     /     / /      /   \ /   \ | |\   |  '   /   
|,_-<  |     |     | |__.   |,_-' |__-' | | \  |      |   
|    ` |     |     | |      |     |  \  | |  \ |      |   
`----' /---/  `._.'  /----/ /     /   \ / |   \|      /   
                                                            
"""

class Blueprint(object):

    """
    Class Blueprint, a plan in hand,
    Where floors align to firmly stand.
    It holds them close, a steady guide,
    Creating form, with structure wide.
    """

    def __init__(self, floors):
        self.floors = floors





    def get_ASCII_blueprint(self):

        # The blueprint begins with a frame so grand,  
        # A border to guide the design by hand.   
        ascii = "      ____________________     \n"
        ascii +=".    /                    \\     "

        # Through each floor, we weave and trace,  
        # Giving each level its rightful place. 
        for i, floor in enumerate(self.floors):

            floor_number = floor.number     # The floor's number, where it resides 
            function = floor.function       # The role it plays, its function in strides


            # We count the letters, the function’s length,  
            # Then balance the spaces, to give it its strength. 
            string_length = len(list(function))
            white_spaces_number = 20 - string_length

            # Half the spaces, to center the name,  
            # Ensuring balance, symmetry the aim. 
            half_spaces_float = white_spaces_number / 2
            half_spaces_int = int(half_spaces_float)
            

            # Now we build the spaces, soft and wide,  
            # To frame the function on either side.  
            white_spaces = []
            one_space = ""

            for i in range(0, half_spaces_int, 1):
                white_spaces.append(" ")
                if (white_spaces_number % 2 == 1):
                    one_space = " "
            
            # Join the spaces, a perfect line,  
            # Ready to place the function so fine. 
            white_spaces = "".join(white_spaces)


            # Add the function and number with grace,  
            # As each floor takes its rightful space.  
            ascii += ("\n     |{}{}{}{}|              {}. Floor".format(white_spaces, function.upper(), white_spaces, one_space, floor_number))
            
        
        # The blueprint ends with a closing sign,  
        # A boundary firm, the design divine.  
        ascii += "\n________________________________\n"
        ascii += "////////////////////////////////"

        # The masterpiece complete, ready to unfold,  
        # A blueprint of stories, in numbers bold.  
        return ascii
# ---------- end create_blueprint ----------
panel_17 = Panel(create_blueprint.ascii_section)
py3_12 = Python3Script(metadata=py3_4.metadata)  # -> size_x, size_y, extent_x, extent_y
# ---------- py3_12: Python ----------
size_x = metadata.get('size_x')
size_y = metadata.get('size_y')

extent_x = metadata.get('extent_x')
extent_y = metadata.get('extent_y')
# ---------- end py3_12 ----------
# Create Terrain
create_terrain = Python3Script(size_x=py3_12.size_x, size_y=py3_12.size_y, extent_x=py3_12.extent_x, extent_y=py3_12.extent_y)  # -> terrain, simplify(chunks); inputs size_x: Double, size_y: Double, extent_x: Int32, extent_y: Int32
# ---------- create_terrain: Python ----------
import System
import Rhino
import Grasshopper

import rhinoscriptsyntax as rs
import ghpythonlib.components as ghcomp
from ghpythonlib import treehelpers
from Rhino.Geometry import Plane, Point3d
import rhinoscriptsyntax as rs




class MyComponent(Grasshopper.Kernel.GH_ScriptInstance):
    def RunScript(self, size_x: float, size_y: float, extent_x: int, extent_y: int):


        print(size_x, size_y, extent_x, extent_y)

        if size_x == None: 
            size_x = 1
        if size_y == None:
            size_y = 1
        if extent_x == None:
            extent_x = 10
        if extent_y == None:
            extent_y = 10


        # A plane of origin, from points it does rise,a
        # The basis of geometry beneath endless skies.
        origin_plane = Plane(Point3d(0, 0, 0), Point3d(1, 0, 0), Point3d(0, 1, 0))
        
        # Rectangles emerge, like tiles on a floor,
        # Crafted by Rectangular, their shapes we explore.
        rectangles = ghcomp.Rectangular(origin_plane, size_x, size_y, extent_x, extent_y).cells
        
        # From a collection, we form a reversed stream,
        # To organize rectangles with a logical theme.
        rectangles = list(rectangles)

        
        # Dividing rectangles into chunks so grand,
        # Each group aligned by the extent's command.
        chunks = partition_list(rectangles, extent_y)
        
        # Convert the chunks to a tree, so it may grow,
        # Nested structures where data may flow.
        #chunks = treehelpers.list_to_tree(chunks)
        
        # A terrain we shape, a surface we plot,
        # Upon the WorldXY plane, our design is brought.
        terrain = rs.AddPlaneSurface( rs.WorldXYPlane(), size_x * extent_x, size_y * extent_y)

        chunks = [item for sublist in chunks for item in sublist]
        
        ghenv.Component.Message = "Terrain generated"

        return terrain, chunks


def partition_list(lst, num):
    # To break the list into chunks so neat,
    # Dividing it whole, into pieces discrete.
    return [lst[i:i + num] for i in range(0, len(lst), num)]
# ---------- end create_terrain ----------
py3_13 = Python3Script(metadata=py3_4.metadata)  # -> extent_x, extent_y
# ---------- py3_13: Python ----------
extent_x = metadata.get('extent_x')
extent_y = metadata.get('extent_y')
# ---------- end py3_13 ----------
pt = Point(area.Centroid)
# Create Alive Scheme
create_alive_scheme = Python3Script(x=py3_13.extent_x, y=py3_13.extent_y, chunks=create_terrain.chunks, points=pt)  # -> alive_scheme; inputs x: Int32, y: Int32, chunks: list of Rectangle3d, points: list of Point3d
# ---------- create_alive_scheme: Python ----------
"""Grasshopper Script Instance"""
import System
import Rhino
import Grasshopper

from Rhino.Geometry import PointContainment

import rhinoscriptsyntax as rs
import ghpythonlib.treehelpers as th


"""
        if chunks.BranchCount == 0 and points == None:
            ghenv.Component.Message = "Please provide chunks\n Please provide points"
            return
        elif points == None:
            ghenv.Component.Message = "Please provide points"
            return
        elif chunks.BranchCount == 0:
            ghenv.Component.Message = "Please provide chunks"
            return
"""


"""
In a terrain vast, with chunks so wide,
The user's points in stillness bide.
Each cell awaits with space to fill,
To catch the points that lie at will.
"""

chunk_i = 0
alive_scheme = []

# We traverse each branch, through the grid’s domain,  
# A map of chunks, each path we attain.  
for ix in range(x):
    # For each cell in the list, we start our quest,  
    # Checking if points lie within, at their best.  
    for iy in range(y):
        
        # Now the points, scattered and free,  
        # Will find their place in the chunks, you’ll see.  
        for point in points:

            """
            Does the point lie within the chunk's form?
            """
            containement = chunks[chunk_i].Contains(point)
            if containement == PointContainment.Inside:
                is_inside = True
            else:
                is_inside = False                

            # If the point’s inside, we make it known,  
            # Record the position, its status shown.  
            if is_inside:
                 # Print the status, where it belongs
                alive_chunk = [ix, iy]                 # A cell marked alive, as the scheme grows strong
                alive_scheme.append(alive_chunk)     # Add it to the scheme, the list prolongs

        chunk_i += 1


# Finally, the alive scheme, all laid out,  
# Points in chunks, without a doubt.  
print(alive_scheme)
#alive_scheme = th.list_to_tree(alive_scheme)

ghenv.Component.Message = "Alive-Scheme created"
# ---------- end create_alive_scheme ----------
py3_14 = Python3Script(metadata=py3_4.metadata)  # -> extent_x, extent_y, cell_height
# ---------- py3_14: Python ----------
extent_x = metadata.get('extent_x')
extent_y = metadata.get('extent_y')
cell_height = metadata.get('size_z')
# ---------- end py3_14 ----------
cellular_automata = BooleanToggle(True)
# Cellular Automata
cellular_automata_2 = Python3Script(
    chunks=create_terrain.chunks,
    x=py3_14.extent_x,
    y=py3_14.extent_y,
    cell_height=py3_14.cell_height,
    alive_scheme=create_alive_scheme,
    blueprint=create_blueprint.blueprint,
    run_cellular_automata=cellular_automata)  # -> organism; inputs chunks: list of Rectangle3d, x: Int32, y: Int32, cell_height: Int32, alive_scheme: list
# ---------- cellular_automata_2: Python ----------
from compas_rhino.devtools import DevTools
DevTools.ensure_path()


import compas
from compas.geometry import Box, Point, Line
from compas_rhino.conversions import box_to_rhino

import ghpythonlib.treehelpers as th

from poems.cellular_automata import Cell
from poems.cellular_automata import Organism


new_alive_scheme = []

for item in alive_scheme:
    new_alive_scheme.append([item[0], item[1]])
print(new_alive_scheme)

if cell_height == None:
    cell_height = 1

#if chunks.BranchCount == 0:
#    ghenv.Component.Message = "Please provide chunks"

#elif alive_scheme.BranchCount == 0:
#    ghenv.Component.Message = "Please provide alive alive scheme"

elif blueprint == None:
    ghenv.Component.Message = "Please provide blueprint"

if  not run_cellular_automata:
    ghenv.Component.Message = "All set up: let's evolve!" 
else:
    ghenv.Component.Message = "Evolved"       


    # The journey begins, where time stretches forward.
    max_generations = len(blueprint.floors)

    # A new life is born, full of potential, shaped by its blueprint.
    organism = Organism(max_generations, blueprint, chunks, x, y)

    # The first breath is taken, the beginning of all things.
    #alive_scheme = th.tree_to_list(alive_scheme)
    organism.set_generation_zero(new_alive_scheme, cell_height)

    # The first cells stir, awakening to the world.
    cells = organism.get_cells()

    # A decision, to follow the path of life or let it fade into stillness.
    if run_cellular_automata:

        # The dance of life unfolds, a cellular symphony of creation and decay.
        cells = organism.cellular_automata(cell_height)
# ---------- end cellular_automata_2 ----------
disc = Discontinuity(Curve=cull_i, Level=1)  # -> Points, Parameters
disc_2 = Discontinuity(Curve=cull_i_2, Level=1)  # -> Points, Parameters
hull2d = ConvexHull(Points=disc.Points, Plane=PlaneXY(0, 0, 0))  # -> Hull, HullZ, Indices
hull2d_2 = ConvexHull(Points=disc_2.Points, Plane=PlaneXY(0, 0, 0))  # -> Hull, HullZ, Indices
# MODIFIER
py3_15 = Python3Script(organism=cellular_automata_2, working_node="home")  # -> organism
# ---------- py3_15: Python ----------
import math

if working_node.upper() == 'PARKING':

    for cell in organism.cells:
        if cell.generation % 2 != 0:
            cell.live()





elif working_node.upper() == 'STREET':
    for cell in organism.cells:
        cell.live()


elif working_node.upper() == 'HIGHWAY':
    for cell in organism.cells:
        cell.live()




elif working_node.upper() == 'INTERSECTION':
    for cell in organism.cells:

        if cell.index >= 6 and cell.index <=8:
            cell.live()
        
        if cell.row >= 6 and cell.row <=8:
            cell.live()
        
        if cell.generation == 0 or cell.generation == 2:
            cell.die()



elif working_node.upper() == 'HOUSE' or working_node.upper() == 'HOME':
    for cell in organism.cells:
        if cell.index % 4 == 3 and cell.row%4 == 3 and cell.generation%4 == 3:
            cell.live()



elif working_node.upper() == 'WAREHOUSE':
    for cell in organism.cells:
        cell.live()



elif working_node.upper() == 'STORE':
    for cell in organism.cells:
        cell.live()
        if cell.generation == organism.generations-1:
            print(True)
            cell.die()



elif working_node.upper() == 'LAUNDROMAT':
    for cell in organism.cells:
        cell.live()
        if cell.generation == organism.generations-1:
            print(True)
            cell.die()



elif working_node.upper() == 'POST':
    for cell in organism.cells:
        cell.live()
        if cell.generation == organism.generations-1:
            print(True)
            cell.die()



elif working_node.upper() == 'FACTORY':
    for cell in organism.cells:
        if cell.generation <= 4:
            cell.live()




elif working_node.upper() == 'RIVER':
    for cell in organism.cells:
        y = round(3*math.sin(cell.generation/3) + 4)

        if cell.index == y:
            cell.live()


elif working_node.upper() == 'SEA':
    for cell in organism.cells:
        y = round(3*math.sin(cell.generation/3) + 4)

        if cell.index == y:
            cell.live()



elif working_node.upper() == 'BEACH':
    for cell in organism.cells:
        y = round(3*math.sin(cell.generation * 100/(cell.generation+2)) + 4)

        if cell.index == y:
            cell.live()





elif working_node.upper() == 'AIRPORT':

    for cell in organism.cells:
        
        if cell.row >= 6 and cell.generation == 0: 
            cell.live()


elif working_node.upper() == 'PORT':

    for cell in organism.cells:

        if cell.generation != 0:
            continue
        
        if cell.row in [4, 5, 8, 9]:
            cell.live()

        

        
        




for cell in organism.cells: 
    if cell.row == 0:
        cell.die()
    if cell.index == 0:
        cell.die()
    if cell.row == organism.n_rows-1:
        cell.die()
    if cell.index == organism.n_indices-1:
        cell.die()
# ---------- end py3_15 ----------
visualize_organism = Python3Script(organism=py3_15)  # -> simplify(geometry)
# ---------- visualize_organism: Python ----------
import System
import Rhino
import Grasshopper

import rhinoscriptsyntax as rs
import ghpythonlib.treehelpers as th
from compas_rhino.conversions import box_to_rhino


geometry = []

print(organism)

for c in organism.get_cells():
    if c.is_alive():
        box = c.draw_box()
        geometry.append(box_to_rhino(box))
#geometry = th.list_to_tree(geometry)
# ---------- end visualize_organism ----------
py3_16 = Python3Script(metadata=py3_4.metadata)  # -> generations, size_z
# ---------- py3_16: Python ----------
generations = metadata.get('generations')
size_z = metadata.get('size_z')
# ---------- end py3_16 ----------
py3_17 = Python3Script(metadata=py3_4.metadata)  # -> generations, size_z; same code as py3_16
multiplication = Multiplication(A=py3_16.generations, B=py3_16.size_z)
multiplication_2 = Multiplication(A=py3_17.generations, B=py3_17.size_z)
# Visualize Organism
colour_swatch = ColourSwatch(SwatchColor=RGB(95, 131, 158))
reb = RebuildCurve(Curve=hull2d.Hull, Degree=Slider(10, range=0..10), Count=expr("x/2", 10), Tangents=False)
reb_2 = RebuildCurve(Curve=hull2d_2.Hull, Degree=Slider(10, range=0..10), Count=expr("x/2", 10), Tangents=False)
Z = UnitZ(Factor=multiplication)
Z_2 = UnitZ(Factor=multiplication_2)
custom_preview_4 = CustomPreview(Geometry=visualize_organism, Material=colour_swatch)
extr = Extrude(Base=reb, Direction=Z)
extr_2 = Extrude(Base=reb_2, Direction=Z_2)
cap = CapHoles(Brep=extr)  # -> flatten(Brep)
cap_2 = CapHoles(Brep=extr_2)  # -> flatten(Brep)
preview_5 = CustomPreview(Geometry=cap, Material=ColourSwatch(SwatchColor=RGBA(0, 255, 0, 75)))
preview_6 = CustomPreview(Geometry=cap_2, Material=ColourSwatch(SwatchColor=RGBA(255, 0, 0, 75)))
debrep_3 = DeconstructBrep(Brep=py3_3.cells)  # -> Faces, Edges, Vertices
volume = Volume(Geometry=py3_3.cells)  # -> Volume, Centroid
positioning = Slider(5, range=0..10)
area_2 = Area(Geometry=debrep_3.Faces)  # -> Area, Centroid
sort_4 = SortList(Keys=area_2.Area, ValuesA=debrep_3.Faces)  # -> Keys, ValuesA
# Generate Point Cloud
generate_point_cloud = Python3Script(organism=py3_15, division_factor=Slider(1, range=1..3))  # -> cells, alive_cells, dead_cells, point_cloud, interesting_cells; inputs division_factor: Int32
# ---------- generate_point_cloud: Python ----------
from compas_rhino.devtools import DevTools
DevTools.ensure_path()


import ghpythonlib.treehelpers as th

from compas.geometry import Point, Line, Curve
from compas_rhino.conversions import box_to_rhino, point_to_rhino, point_to_compas

from poems.generate_pointcloud import remove_duplicate_points
from poems.generate_pointcloud import check_cell_distance
from poems.generate_pointcloud import get_interesting_cells 




if division_factor == None:
    division_factor = 1

if organism == None:
    ghenv.Component.Message = "Please provide organism"



# The organism grows, its cells divide, 
# Increasing their density with a factor in hand
organism.increase_cell_density(division_factor)
# Newborn cells emerge, small and delicate they are,
# The list of cells updates, like a growing star
organism.update_cells_list_with_small_cells()
# All the cells in the organism, gathered as one,
# A universe of life, where growth has begun
cells = organism.get_cells()
# The living cells, full of life and light,
# A shining constellation that brightens the night
alive_cells = organism.get_alive_cells()
# The dead cells, dim and still in their place,
# Awaiting their fate in this cosmic space
dead_cells = organism.get_dead_cells()
# Only keep the dead cells near life’s embrace,
# For those who are close, we’ll keep in this place
trimmed_dead_cells = []
for cell in dead_cells:
    # If a dead cell is near a living star,
    # It has the chance to stay, not to wander too far
    if organism.is_neighbour_cell_alive(cell):
        trimmed_dead_cells.append(cell)
# The list of the dead cells, trimmed and refined,
# Now only those near life will remain in kind
dead_cells = []
dead_cells = trimmed_dead_cells.copy()
# From the living cells, a point cloud we weave,
# Each vertex a star, each point a reprieve
point_cloud = []
for cell in alive_cells:
    # The vertices of life, scattered and bright,
    # We gather them all to create the night
    points = cell.get_vertices_points()
    for pt in points:
        point_cloud.append(pt)
# Remove the duplicates, keep only the pure,
# Like stars in the sky, let them endure
point_cloud = remove_duplicate_points(point_cloud)
# And now, we seek the cells of interest, near,
# Dead but close to life, they are drawn near
interesting_cells = get_interesting_cells(point_cloud, dead_cells)

#cells = th.list_to_tree(cells)
#alive_cells = th.list_to_tree(alive_cells)
#dead_cells = th.list_to_tree(dead_cells)
#point_cloud = th.list_to_tree(point_cloud)
#interesting_cells = th.list_to_tree(interesting_cells)

ghenv.Component.Message = "Point cloud generated"
# ---------- end generate_point_cloud ----------
item = ListItem(List=sort_4.ValuesA, Index=positioning, Wrap=True)
planar = IsPlanar(Surface=item, Interior=True)  # -> Planar, Plane
vec2pt = Vector2Pt(PointA=planar.Plane, PointB=volume.Centroid, Unitize=False)  # -> Vector, Length
pl = PlaneNormal(Origin=planar.Plane, ZAxis=vec2pt.Vector)

py3_18 = Python3Script(metadata=py3_4.metadata)  # -> green_function
# ---------- py3_18: Python ----------
green_function = metadata.get('green_function') or False
# ---------- end py3_18 ----------
py3_19 = Python3Script(cells=generate_point_cloud.interesting_cells, breps=cap, new_function=py3_18)  # -> cells; inputs cells: list, breps: list of Brep, new_function: String
# ---------- py3_19: Python ----------
from compas_rhino.conversions import box_to_rhino
from compas.geometry import Brep



if __name__ == "__main__":

    if breps == []:

        cells = cells

    elif breps[0] != None:
        # Transform breps in compas breps
        breps = [Brep.from_native(brep) for brep in breps]
        print(breps)
        

        # Check if the the alive cell is inside the breps
        new_cells = []

        for cell in cells:
            if not cell.is_alive():
                cell_box = cell.draw_box()
                for brep in breps:
                    if brep.contains(cell_box.frame.point):
                        cell.function = new_function
# ---------- end py3_19 ----------
panel_18 = Panel(py3_18)

# ----
# Visualize Point Cloud
visualize_point_cloud = Python3Script(point_cloud=generate_point_cloud.point_cloud)  # -> points; inputs point_cloud: list
# ---------- visualize_point_cloud: Python ----------
import System
import Rhino
import Grasshopper

import rhinoscriptsyntax as rs
import ghpythonlib.treehelpers as th
from compas_rhino.conversions import point_to_rhino


class MyComponent(Grasshopper.Kernel.GH_ScriptInstance):
    def RunScript(self, point_cloud: System.Collections.Generic.List[object]):
        points = []
        for p in point_cloud:
            points.append(point_to_rhino(p))
        #points = th.list_to_tree(points)
        return points
# ---------- end visualize_point_cloud ----------
# Visualize Cells
visualize_cells = Python3Script(cells=generate_point_cloud.alive_cells)  # -> geometry; inputs cells: list
# ---------- visualize_cells: Python ----------
import System
import Rhino
import Grasshopper

import rhinoscriptsyntax as rs
import ghpythonlib.treehelpers as th
from compas_rhino.conversions import box_to_rhino

class MyComponent(Grasshopper.Kernel.GH_ScriptInstance):
    def RunScript(self, cells: System.Collections.Generic.List[object]):
        geometry = []
        
        for c in cells:
            box = c.draw_box()
            geometry.append(box_to_rhino(box))

        #geometry = th.list_to_tree(geometry)
        return geometry
# ---------- end visualize_cells ----------
custom_preview_5 = CustomPreview(Geometry=visualize_cells, Material=ColourSwatch(SwatchColor=RGB(95, 131, 158)))
custom_preview_6 = CustomPreview(Geometry=visualize_point_cloud, Material=ColourSwatch(SwatchColor=RGB(158, 68, 68)))
xy = XYPlane(Origin=Point(0, 0, 0))
yz = YZPlane(Origin=Point(0, 0, 0))
xz = XZPlane(Origin=Point(0, 0, 0))

py3_20 = Python3Script(metadata=py3_4.metadata)  # -> red_function
# ---------- py3_20: Python ----------
red_function = metadata.get('red_function') or False
# ---------- end py3_20 ----------
py3_21 = Python3Script(cells=py3_19, breps=cap_2, new_function=py3_20)  # -> cells; inputs cells: list, breps: list of Brep, new_function: String
# ---------- py3_21: Python ----------
from compas_rhino.conversions import box_to_rhino
from compas.geometry import Brep



if __name__ == "__main__":

    if breps[0] != None:
        # Transform breps in compas breps
        breps = [Brep.from_native(brep) for brep in breps]
        print(breps)
        

        # Check if the the alive cell is inside the breps
        new_cells = []

        for cell in cells:
            if not cell.is_alive():
                cell_box = cell.draw_box()
                for brep in breps:
                    if brep.contains(cell_box.frame.point):
                        cell.function = new_function
# ---------- end py3_21 ----------
panel_19 = Panel(py3_20)

rotate = Rotate(Angle=degrees(Slider(0, range=-100..180)), Plane=xy)  # -> Geometry, Transform
rotate_2 = Rotate(Angle=degrees(Slider(0, range=-100..100)), Plane=yz)  # -> Geometry, Transform
rotate_3 = Rotate(Angle=degrees(Slider(0, range=-100..100)), Plane=xz)  # -> Geometry, Transform
vec = VectorXYZ(XComponent=Slider(0, range=-100..100), YComponent=Slider(0, range=-100..100), ZComponent=Slider(0, range=-100..100))  # -> Vector, Length
panel_20 = Panel(cap_2)
move = Move(Motion=vec.Vector)  # -> Geometry, Transform
# Move the building
terrain = Surface(create_terrain.terrain)
path_3 = FilePath("C:\Users\computer-1\ERIC_DOCUMENTS\PANNUSTHEKA\")
area_3 = Area(Geometry=terrain)  # -> Area, Centroid
srfpt = SurfacePoints(Surface=terrain)  # -> Points, Weights, Greville, UCount, VCount
pannustheka_2 = FilePath(path_3)
fline = FitLine(Points=srfpt.Points)
pt_2 = Point(area_3.Centroid)
marching_cubes = BooleanToggle(True)
# Marching Cubes
marching_cubes_2 = Python3Script(
    point_cloud=generate_point_cloud.point_cloud,
    interesting_cells=py3_21,
    library=pannustheka_2,
    start_marching=marching_cubes)  # -> out, envelope; inputs point_cloud: list, interesting_cells: list
# ---------- marching_cubes_2: Python ----------
# venv: HAL2

"""Grasshopper Script Instance"""
import System
import Rhino
import Grasshopper

import rhinoscriptsyntax as rs
import ghpythonlib.treehelpers as th
from compas_rhino.conversions import point_to_compas, mesh_to_compas
from compas.geometry import Transformation, Translation, Vector, Scale, Frame
import Rhino.FileIO



class MyComponent(Grasshopper.Kernel.GH_ScriptInstance):
    def RunScript(self,
            point_cloud: System.Collections.Generic.List[object],
            interesting_cells: System.Collections.Generic.List[object],
            library,
            start_marching):


        if point_cloud == None:
            ghenv.Component.Message = "Please provide point cloud"
            return
        elif interesting_cells == None:
            ghenv.Component.Message = "Please provide interesting_cells" 
            return
        elif library == None:
            ghenv.Component.Message = "Pleas provde file-path to the pannustheka"
            return
        elif not start_marching:
            ghenv.Component.Message = "All set up: start marching!"
            return   
        
        if start_marching:
            ghenv.Component.Message = "Marched!"

            """
            The call to arms is clear, the march begins,  
            With troops assembled, the battle we win..
            """
            
            marching_cube = MarchingCubes(interesting_cells, point_cloud)
            marching_cube.set_scale_factor()

            """
            The battlefield is surveyed, the scale is set,  
            The troops are measured, their positions are met.
            """

            marching_cube.run_marching_cubes(library)

            """
            The order is given, the troops advance,  
            Cells and cubes in perfect stance.
            """
            
            envelope = marching_cube.envelope
            print(envelope)
            """
            The march complete, the envelope now holds,  
            Victory secured, the story unfolds.
            """
        #envelope = th.list_to_tree(envelope)
        return envelope





 
"""
                                                                                                      
   _____    ______  _____    __   __   _     _  _______   _____   _______  _______   _____    _     _ 
  (_____)  (______)(_____)  (__)_(__) (_)   (_)(__ _ __) (_____) (__ _ __)(_______) (_____)  (_)   (_)
  (_)__(_) (_)__   (_)__(_)(_) (_) (_)(_)   (_)   (_)   (_)___(_)   (_)      (_)   (_)   (_) (__)_ (_)
  (_____)  (____)  (_____) (_) (_) (_)(_)   (_)   (_)   (_______)   (_)      (_)   (_)   (_) (_)(_)(_)
  (_)      (_)____ ( ) ( ) (_)     (_)(_)___(_)   (_)   (_)   (_)   (_)    __(_)__ (_)___(_) (_)  (__)
  (_)      (______)(_)  (_)(_)     (_) (_____)    (_)   (_)   (_)   (_)   (_______) (_____)  (_)   (_)
                                                                                                      
                                                                                                      
"""
class Permutation(object):

    """
    In a world where geometry and logic weave,  
    A husband and wife, in harmony, believe.  
    Through layers and shapes, their journey flows,  
    Unlocking patterns that no one knows.  
    With rules in hand, they venture deep,  
    Revealing secrets that models keep.  
    One permutation at a time, they strive,  
    Bringing structure and form alive.
    """

    def __init__(self):
        self.mesh = None
        self.points = None
        self.bounding_box_points = None


    def import_from_pannustheka(self, cell, rule, library):

        function = cell.function
        if function == None: function = "default"


        # Wife:     "Does this rule fit, my dear?  
        #           Is it too small, or too big, I fear?"  

        # Husband:  "It must be eight, no more, no less,  
        #           For only then, the we will progress." 


        if len(rule) > 8 or len(rule) < 8: return None
        if rule == [0,0,0,0,0,0,0,0] or rule == [1,1,1,1,1,1,1,1]:
            return None

        i=0
        for index in rule:
            i = i+index


        # Wife:     "Shall we go left, or take the right?  
        #           Invert the rule, if the sum’s too bright?"  

        # Husband:  "If the sum’s too high, we must reverse,  
        #           Invert the bits, and try it inverse." 


        if i > 4:
            inverted_rule = []
            for index in rule:
                if index == 0:
                    inverted_rule.append(1)
                else:
                    inverted_rule.append(0)
            rule = inverted_rule
        file_path = library + function + "_" + str(rule) + ".3dm"


        # Wife:     "Let’s open the file, see what we’ve got,  
        #           Will it fit, or shall we not?"  

        # Husband:  "We’ll try our best, and test once more,  
        #           If it fails, we’ll open the next door."  


        try:
            model = Rhino.FileIO.File3dm.Read(file_path)
        except:          
            # Wife: "Oh no, the file’s not quite right,  
            #       But we’ll move on, and not lose sight."
            return


        objects = model.Objects
        

        # Wife:     "Now we check the layers, all must be clear,  
        #           For each one, we must draw near."  

        # Husband:  "I’ll sort them out, don’t you fear,  
        #           The geometry’s path will soon appear."

        layer_table = model.AllLayers

        geometries = []
        points_list = []
        bbpoints_list = []
        

        # Wife:     "Into the layers, we dive with care,  
        #           Meshes and points must be handled fair."  
        # Husband:  "Each one will fall in the right place,  
        #           So we can see the full design’s grace."


        for obj in objects:
                    
            if(obj.Attributes.LayerIndex == 0):
                mesh = obj.Geometry
            elif(obj.Attributes.LayerIndex == 1):
                points_list.append(obj.Geometry.Location)
            elif(obj.Attributes.LayerIndex == 2):
                bbpoints_list.append(obj.Geometry.Location)
                                

        # Wife:     "All in place, but now we must see,  
        #           The meshes and points, in compas they’ll be."  

        # Husband:  "Right you are, let’s make the shift,  
        #           So all aligns, and we’ll get the gift."
        

        mesh = mesh_to_compas(mesh)
        points_list = points_to_compas(points_list)
        bbpoints_list = points_to_compas(bbpoints_list)

        self.mesh = mesh
        self.points = points_list
        self.bounding_box_points = bbpoints_list


        # Wife:     "We’re done now, everything’s aligned,  
        #           The data’s set, in perfect bind."  

        # Husband:  "Yes, it’s done, and we can rest,  
        #           The permutation’s path was our best."


  
  
"""
        ___           ___           ___           ___           ___                       ___           ___     
       /\__\         /\  \         /\  \         /\  \         /\__\          ___        /\__\         /\  \    
      /::|  |       /::\  \       /::\  \       /::\  \       /:/  /         /\  \      /::|  |       /::\  \   
     /:|:|  |      /:/\:\  \     /:/\:\  \     /:/\:\  \     /:/__/          \:\  \    /:|:|  |      /:/\:\  \  
    /:/|:|__|__   /::\~\:\  \   /::\~\:\  \   /:/  \:\  \   /::\  \ ___      /::\__\  /:/|:|  |__   /:/  \:\  \ 
   /:/ |::::\__\ /:/\:\ \:\__\ /:/\:\ \:\__\ /:/__/ \:\__\ /:/\:\  /\__\  __/:/\/__/ /:/ |:| /\__\ /:/__/_\:\__\
   \/__/~~/:/  / \/__\:\/:/  / \/_|::\/:/  / \:\  \  \/__/ \/__\:\/:/  / /\/:/  /    \/__|:|/:/  / \:\  /\ \/__/
         /:/  /       \::/  /     |:|::/  /   \:\  \            \::/  /  \::/__/         |:/:/  /   \:\ \:\__\  
        /:/  /        /:/  /      |:|\/__/     \:\  \           /:/  /    \:\__\         |::/  /     \:\/:/  /  
       /:/  /        /:/  /       |:|  |        \:\__\         /:/  /      \/__/         /:/  /       \::/  /   
       \/__/         \/__/         \|__|         \/__/         \/__/                     \/__/         \/__/    
        ___           ___           ___           ___           ___                                             
       /\  \         /\__\         /\  \         /\  \         /\  \                                            
      /::\  \       /:/  /        /::\  \       /::\  \       /::\  \                                           
     /:/\:\  \     /:/  /        /:/\:\  \     /:/\:\  \     /:/\ \  \                                          
    /:/  \:\  \   /:/  /  ___   /::\~\:\__\   /::\~\:\  \   _\:\~\ \  \                                         
   /:/__/ \:\__\ /:/__/  /\__\ /:/\:\ \:|__| /:/\:\ \:\__\ /\ \:\ \ \__\                                        
   \:\  \  \/__/ \:\  \ /:/  / \:\~\:\/:/  / \:\~\:\ \/__/ \:\ \:\ \/__/                                        
    \:\  \        \:\  /:/  /   \:\ \::/  /   \:\ \:\__\    \:\ \:\__\                                          
     \:\  \        \:\/:/  /     \:\/:/  /     \:\ \/__/     \:\/:/  /                                          
      \:\__\        \::/  /       \::/__/       \:\__\        \::/  /                                           
       \/__/         \/__/         ~~            \/__/         \/__/                                            
"""
  
class MarchingCubes(object):

    """
    The battle begins, the troops are in place,  
    We march forward, to conquer the space.  
    With cells of interest and points in the field,  
    Our march takes shape, the victory revealed.
    """

    def __init__(self, interesting_cells, point_cloud):

        """
        The command is set, the units are named,  
        Interesting cells, point clouds — our aim.  
        With factors of scale, ready for the task,  
        We prepare the troops, and await the ask
        """

        self.envelope = []                          # The formation is set, the envelope our shield.

        self.interesting_cells = interesting_cells  # The cells we command, our front line strong.
        self.point_cloud = point_cloud              # # The points of reference, where we belong.

        self.scale_x_factor = None                  # The width to be scaled, the ground we must cross.
        self.scale_y_factor = None                  # The height to be scaled, no room for loss.
        self.scale_z_factor = None                  # The depth to be scaled, through which we march.

        self.set_scale_factor()                     # The first order: Set the scale, our marching arch.




    def set_scale_factor(self):

        """
        The terrain is surveyed, the cells we inspect,  
        With boxes drawn, our first step to perfect.  
        The scale must be set, to match the size,  
        For the troops to advance, under careful eyes.
        """

        # Survey the land, the box must be drawn.
        cell_box = self.interesting_cells[0].draw_box()

        # The width of the battlefield is ours to command.
        self.scale_x_factor = cell_box.xsize 
        # The height is adjusted, we take our stand.
        self.scale_y_factor = cell_box.ysize
        # Depth is measured, our path is planned.
        self.scale_z_factor = cell_box.zsize 




    def add_permutation(self, permutation, destination_cell):
        
        """
        Now the battle begins, the forces move,  
        A permutation is placed, a strategic groove.  
        With translation and scale, we shift our might,  
        As soldiers are aligned, ready for the fight.
        """
        # Define the movement of the troops, as we prepare to advance.
        if permutation is not None:

            # Translation vector, the path to be walked,
            translation_vector = Vector.from_start_end(permutation.bounding_box_points[0], 
                                                        destination_cell.get_vertices_points()[0])
            translation_matrix = Translation.from_vector(translation_vector)
            
            # Transformation origin, we set our base,
            transformation_origin = Frame.from_points(permutation.bounding_box_points[0], 
                                                    permutation.bounding_box_points[1], 
                                                    permutation.bounding_box_points[3])
            
            # Scaling transformation, to match the size of our force,
            scale_transformation = Scale.from_factors([self.scale_y_factor, 
                                                        self.scale_x_factor, 
                                                        self.scale_z_factor], 
                                                        frame=transformation_origin)
            
            # The mesh is copied, to be transformed with care.
            tile = permutation.mesh.copy()
            # Scaling our force, for the next phase of war.
            tile.transform(scale_transformation)
            # Moving into position, with orders clear and fair.
            tile.transform(translation_matrix)



            # The troops are ready, within the envelope they stay.
            self.envelope.append(tile)



    def run_marching_cubes(self, library):

        """
        The campaign begins, the battle unfolds,  
        As we march across, the story is told.  
        We march through cells, with vertices in hand,  
        The marching cubes advance, to take the land.
        """
        
        for cell in self.interesting_cells:
            # The formation is drawn, the vertices placed,
            # Our strategic points, carefully traced.
            cell_vertices = []
            for i in range(0, 8):
                # Marking each corner, to ensure no mistake.
                cell_vertices.append(cell.draw_box().corner(i))
            
            # The passport is scanned, the rule must be known,
            cell_rule = cell.get_passport(self.point_cloud)
            # The rule to guide us, as we march alone.

            # A new permutation, ready to deploy.
            permutation = Permutation()
            permutation.import_from_pannustheka(cell, cell_rule, library)
            # The orders are sent, the cell is employed.

            if permutation.mesh is not None:
                # The force is ready, marching through the field,
                self.add_permutation(permutation, cell)
                # We add the permutation, our victory sealed.




  


def points_to_compas(points):

    """
    The point’s journey begins, small yet grand,  
    To Compas they travel, at the general’s command.  
    Each point, a hero, with a single quest,  
    To transform and align, and do their best.
    """

    compas_points = []
    for pt in points:
        compas_points.append(point_to_compas(pt))
    return compas_points
    


def meshes_to_compas(meshes):

    """
    The meshes prepare, their form set to change,  
    To Compas they travel, through the fields they range.  
    Each mesh, a warrior, both sturdy and wise,  
    Transformed and aligned, before our eyes.
    """
    
    mesh_compas = []
    for m in meshes:
        mesh_compas.append(mesh_to_compas(m))
    return mesh_compas
# ---------- end marching_cubes_2 ----------
xy_2 = XYPlane(Origin=pt_2)
colour_swatch_2 = ColourSwatch(SwatchColor=RGB(48, 40, 255))
align = AlignPlane(Plane=xy_2, Direction=fline)  # -> Plane, Angle
visualize_envelope = Python3Script(envelope=marching_cubes_2.envelope)  # -> geometry; inputs envelope: list
# ---------- visualize_envelope: Python ----------
# venv: ca-fs25

import System
import Rhino
import Grasshopper

import rhinoscriptsyntax as rs
import ghpythonlib.treehelpers as th
from compas_rhino.conversions import mesh_to_rhino


class MyComponent(Grasshopper.Kernel.GH_ScriptInstance):
    def RunScript(self, envelope: System.Collections.Generic.List[object]):
        geometry = []
        for m in envelope:
            geometry.append(mesh_to_rhino(m))

        #geometry = th.list_to_tree(geometry)
        return geometry
# ---------- end visualize_envelope ----------
orient = Orient(Source=align.Plane, Target=pl)  # -> Geometry, Transform
merge = Merge(Data1=rotate.Transform, Data2=rotate_2.Transform, Data3=rotate_3.Transform, Data4=move.Transform, Data5=orient.Transform)  # -> flatten(Result)
comp = Compound(Transforms=merge)
custom_preview_7 = CustomPreview(Geometry=visualize_envelope, Material=ColourSwatch(SwatchColor=RGB(140, 102, 158)))
transform = Transform(Geometry=visualize_organism, Transform=comp)
transform_2 = Transform(Geometry=visualize_envelope, Transform=comp)
sint = SolidIntersection(BrepsA=py3_3.cells, BrepsB=transform)
area_4 = Area(Geometry=transform_2)  # -> Area, Centroid
brepinc = PointInBrep(Brep=py3_3.cells, Point=area_4.Centroid, Strict=True)
dispatch = Dispatch(List=transform_2, DispatchPattern=brepinc)  # -> ListA, ListB
colour_swatch_3 = ColourSwatch(SwatchColor=RGB(255, 120, 255))
concat = Concatenate(FragmentA="facade", FragmentC="_", FragmentB="home")
custom_preview_8 = CustomPreview(Geometry=sint, Material=ColourSwatch(SwatchColor=RGB(70, 170, 255)))
custom_preview_9 = CustomPreview(Geometry=dispatch.ListA, Material=colour_swatch_2)
layer_5 = ModelLayer(Name=concat, DisplayColour=colour_swatch_2)  # -> Layer, Name, Hidden, Locked, DisplayColour, Material, Linetype
object_5 = ModelObject(Geometry=dispatch.ListA, Layer=layer_5.Layer)  # -> Object, Geometry, Name, Layer, Visibility, Display, Drafting, Render
concat_2 = Concatenate(FragmentA="volume", FragmentC="_", FragmentB="home")
layer_6 = ModelLayer(Name=concat_2, DisplayColour=ColourSwatch(SwatchColor=RGB(70, 170, 255)))  # -> Layer, Name, Hidden, Locked, DisplayColour, Material, Linetype
object_6 = ModelObject(Geometry=sint, Layer=layer_6.Layer)  # -> Object, Geometry, Name, Layer, Visibility, Display, Drafting, Render
merge_2 = Merge(Data1=object_5.Object, Data2=object_6.Object)
cache_2 = ContentCache(Content=merge_2, Action=2)  # -> Content, Result
