# Grasshopper definition graph_on_rhino.gh (Grasshopper 1.0.8)

path = FilePath("/Users/ericgozzi/Desktop/HAL-Computation/narratives/")
py3 = Python3Script(directory=path, narrative="Chg_city", scale=Slider(70, range=0..100))  # -> out, points, lines, narrative
# ---------- py3: Python ----------
# r: compas>=2.9, compas_timber
# r: opencv-python
# r: reportlab
# r: nltk
# venv: .venv

import compas_rhino
from compas_rhino import DevTools
DevTools.ensure_path()

import ghpythonlib.treehelpers as th

from compas.geometry import Point, Line
from compas_rhino.conversions import point_to_rhino
from compas_rhino.conversions import line_to_rhino

from HAL.metrika.graph import Graph
from HAL.data import read_file, read_json
from HAL.literate import remove_stopwords, remove_punctuation, remove_numbers, clean_whitespaces, transform_text_in_list, remove_verbs, lemmatize_text, remove_adjectives





# IMPORT NARRATIVE
narrative = read_file(f'{directory}{narrative}.txt')

# IMPORT TOP WORDS
top_words = read_json(f'{directory}top_words.json')


# CLEAN NARRATIVE
narrative = remove_stopwords(narrative)
narrative = lemmatize_text(narrative)
narrative = remove_punctuation(narrative)
narrative = remove_numbers(narrative)
narrative = clean_whitespaces(narrative)
narrative = remove_adjectives(narrative)
narrative = remove_verbs(narrative)
narrative = transform_text_in_list(narrative)


def filter_list(base: list, allowed: list) -> list:
    return [item for item in base if item in allowed]

narrative = filter_list(narrative, top_words)

#narrative = ['home', 'age', 'city', 'park', 'design', 'house', 'store', 'end', 'also', 'hour', 'car', 'park', 'four', 'hour', 'city', 'park', 'aspect', 'form', 'therefore', 'might', 'also', 'car', 'car', 'indeed', 'matter', 'time', 'day', 'law', 'along', 'also', 'food', 'production', 'need', 'city', 'city', 'hand', 'car', 'year', 'market', 'palace', 'street', 'behind', 'church', 'garden', 'tree', 'garden', 'park', 'shop', 'people', 'car', 'might', 'region', 'activity', 'place', 'scheme', 'park', 'world']


# REWORK NARRATIVE

city = Graph()
connections = []
for i in range(len(narrative)-1):
    connections.append([narrative[i], narrative[i+1]])
city.add_edges_from_connections(connections)

positions = city.get_nodes_coordinate('KAMADA-KAWAI')



# DRAW THE POINTS
points = []
for word in narrative:
    pos = positions[word]
    points.append(Point(pos[0]*scale, pos[1]*scale, 0))


# DRAW THE EDGES
lines = []
for edge in connections:
    pos1 = positions[edge[0]]
    pos2 = positions[edge[1]]
    print(pos1, pos2)
    ln = Line(Point(pos1[0] * scale, pos1[1] * scale, 0), Point(pos2[0] * scale, pos2[1] * scale, 0))
    lines.append(ln)




# CONVERT TO RHINO
points = [point_to_rhino(pts) for pts in points]
lines = [line_to_rhino(ln) for ln in lines]
narrative = th.list_to_tree(narrative)
# ---------- end py3 ----------
py3_2 = Python3Script(active=Toggle(True))  # -> out
# ---------- py3_2: Python ----------
#r: compas

from compas_rhino.devtools import DevTools
if active:
    DevTools.enable_reloader()
else:
    DevTools.disable_reloader()
# ---------- end py3_2 ----------
annotation_dot = AnnotationDot(Location=py3.points, PrimaryText=py3.narrative)
prox = Proximity2D(Points=py3.points, Plane=PlaneXY(0, 0, 0), Group=5)  # -> Links, Topology
preview = CustomPreview(Geometry=annotation_dot, Material=ColourSwatch(SwatchColor=RGB(0, 0, 0)))
preview_2 = CustomPreview(Geometry=prox.Links, Material=ColourSwatch(SwatchColor=RGB(0, 119, 255)))
